# Grasshopper definition Testobjekt - Algorithmus-Problem.gh (Grasshopper 1.0.7)
# plug-ins: Heteroptera, Human, Kangaroo2 Components, karambaGH

rectangle = Rectangle(Plane=PlaneXY(0, 0, 0), XSize="16", YSize="8", Radius=0)  # -> Rectangle, Length
pop2d = Populate2D(Region=rectangle.Rectangle, Count=Slider(21, range=1..50), Seed=Slider(2, range=0..20))
voronoi = Voronoi(Points=pop2d, Boundary=rectangle.Rectangle, BruteForceOverride=False)
explode = Explode(Curve=voronoi, Recursive=True)  # -> Segments, Vertices
dupln = RemoveDuplicateLines(Lines=flatten(explode.Segments), Tolerance=0.01)
rot3d = Rotate3D(Geometry=dupln, Angle=1.570796327, Center=Point(0, 0, 0), Axis=Vector(16, 0, 0))  # -> Geometry, Transform
lng = ListLength(List=rot3d.Geometry)
_1 = Curve([<curve referenced from the Rhino model> x8])
_2 = Curve(rot3d.Geometry)
_3 = Curve()
_4 = Curve()
_5 = Curve()
_6 = Curve()
_7 = Curve([<curve referenced from the Rhino model> x45])
_8 = Curve()
panel = Panel(lng)
number_slider = Slider(1, range=0..100)
pt = Point(<point referenced from the Rhino model>)
pt_2 = Point([<point referenced from the Rhino model> x2])
crv = Curve([<curve referenced from the Rhino model> x15])  # disabled
brep = Brep(<brep referenced from the Rhino model>)
end = EndPoints(Curve=_1)  # -> Start, End
lng_2 = ListLength(List=end.Start)
panel_2 = Panel(lng_2)

# ---- group: Grid Stairs Geometry
entwine = Entwine(Branch0X=pt, Branch1X=pt_2, Branch2X=_1, Branch3X=brep, FlattenInputs=False)

# ----
# 0 Iterations: Neustart ab 64
panel_3 = Panel(end.Start)
panel_4 = Panel(end.End)

# ---- group: Inputs
bang = ExplodeTree(Data=entwine)  # -> flatten(Branch0), flatten(Branch1), flatten(Branch2), flatten(Branch3)

# ----
item = ListItem(List=panel_3, Index=number_slider, Wrap=True)
item_2 = ListItem(List=panel_4, Index=number_slider, Wrap=True)
crv_2 = Curve(<curve referenced from the Rhino model>)
ln = Line(StartPoint=item, EndPoint=item_2)
explode_2 = Explode(Curve=crv_2, Recursive=True)  # -> Segments, flatten(Vertices)
pipe = Pipe(Curve=ln, Radius="0.2", Caps=0)

# ----
# INSTANTIATE NEW MODEL
# GENERAL INPUTS
# Every Line of the Geometry
# Framework gets divided into n parts
# OPTIONAL GEOMETRY INPUT
# ALTERNATIVE EXAMPLE BOX
# Dimensions
# Infill-Pattern
X = Slider(20, range=1..20)
Y = Slider(10, range=1..20)
Z = Slider(10, range=1..20)
list = ValueList({"Voronoi": 1, "Grid (work in progress)": 2}, selected="Voronoi")
density = Slider(5, range=1..10)
seed = Slider(2, range=0..100)
# INPUT VARIABLES
beam_divisions = Slider(4, range=0..20)
agent_population_box = Box(bang.Branch3)
fixed_support_points = Point(bang.Branch1)
model_framework = Line(bang.Branch2)
fixed_load_points = Point(bang.Branch0)
# DISABLE SOLVER BEFORE EDITING
geometry = GhPythonScript(
    Line_Framework=model_framework,
    Support_Points=fixed_support_points,
    Load_Points=fixed_load_points,
    Load_Vectors=explode_2.Vertices)  # -> Status, geometry; inputs Line_Framework: list of Line, Support_Points: list of Point3d, Load_Points: list of Point3d, Load_Vectors: list of Point3d
# ---------- geometry: Python ----------
#Check for Input
check = 0
Status = []

# Line Framework
if Line_Framework:
    Status.append("Line Framework loaded.")
    check += 1
else:
    Status.append("Line Framework unavailable.")

# Support Points
if Support_Points:
    Status.append("Support Points loaded.")
    check += 1
else:
    Status.append("Support Points unavailable.")

# Load Points
if Load_Points:
    Status.append("Load Points loaded.")
    check += 1
else:
    Status.append("Load Points unavailable.")

print(check)
if check == 3:
    geometry = [Line_Framework, Support_Points, Load_Points, Load_Vectors]
    Status = "Input geometry loaded."
# ---------- end geometry ----------
example_box = GhPythonScript(x=X, y=Y, z=Z, Infill_Pattern=list, Density=density, Seed=seed)  # -> box; inputs Infill_Pattern: Int32; disabled
# ---------- example_box: Python ----------
import Rhino.Geometry as rg
import ghpythonlib.components as ghc

xy_plane = rg.Plane(rg.Point3d(0,0,0),rg.Point3d(1,0,0),rg.Point3d(0,1,0))

frame = rg.Box(xy_plane, [rg.Point3d(0,0,0), rg.Point3d(x, y, z)])
voronoi_pts = ghc.Populate3D(frame, Density, Seed)
cells = ghc.Voronoi3D(voronoi_pts, frame)[0]
tmp = ghc.DeconstructBrep(cells)
lines = ghc.karambaGH.RemoveDuplicateLinesKaramba3D(tmp.edges)[0]
nodes_tmp = rg.Point3d.CullDuplicates(tmp.vertices, 0.001)

x_list = [point.X for point in nodes_tmp]
y_list = [point.Y for point in nodes_tmp]
z_list = [point.Z for point in nodes_tmp]

loads = []
supports = []
tol = 1e-7

for point in nodes_tmp:
    if abs(point.Z - max(z_list)) < tol:
        loads.append(point)
    if abs(point.Z - min(z_list)) < tol:
        if abs(point.X - min(x_list)) < tol or abs(point.X - max(x_list)) < tol:
            if abs(point.Y - min(y_list)) < tol or abs(point.Y - max(y_list)) < tol:
                supports.append(point)

box = [lines, supports, loads, x, y, z]
# ---------- end example_box ----------
panel_5 = Panel(geometry.Status)

# ----
# AGENT BEHAVIOR
# Agent Vision Radius Factor
# Agent Effect Radius Factor
# Agent Strength
# Osteoblast Count
# Osteoclast Count
# Agent Population Seed
# AMOUNT OF ITERATIONS TO CALCULATE
iterations = Slider(1, range=0..10000)
vision_radius = Slider(2, range=0..2)
effect_radius = Slider(1, range=0..2)
strength = Slider(0.9, range=0..1)
osteoblast = Slider(3, range=0..100)
osteoclast = Slider(3, range=0..100)
seed_2 = Slider(1, range=0..1000)
agent_input = GhPythonScript(vr=vision_radius, er=effect_radius, st=strength, ob=osteoblast, oc=osteoclast, se=seed_2)  # -> a; inputs ob: Int32, oc: Int32
# ---------- agent_input: Python ----------
a = [vr, er, st, ob, oc, se]
# ---------- end agent_input ----------

beam_divisions_2 = Integer(beam_divisions)
panel_6 = Panel("152")
number_slider_2 = Slider(1, range=0..5)

# ----
# State
# LOAD EXISTING MODEL
# Mode
# Path (format: "C:\Folder\Folder\Folder\")
# Model status
# File name
# ## = "Show save state"-value is higher than
#           the amount of saved steps in the model
#                -> displaying the latest possible state
# ANALYSE MODEL
# Disables all agent behavior and calculations
# to load raw geometry and values from the file
# Show save state
# CONTINUE PROCESSING
# Continue from latest possible save state
# OR Continue from save state
panel_7 = Panel("C:\University\Master\saves\")
n = Slider(25, range=1..100)
n_2 = Slider(1, range=1..100)
list_2 = ValueList({"Continue Processing": 0, "Analyse Model": 1}, selected="Analyse Model")
on_off = BooleanToggle(False)

# ----
# State
# Deactivate Solver,
# toggle Save ON,
# activate Solver,
# deactivate Solver,
# toggle Save OFF
# SAVE CURRENT MODEL
# File status
# Save states:
#  File size:
# Path (format: "C:\Folder\Folder\Folder\")
# File name
# Save every n iteration
panel_8 = Panel("C:\University\Master\saves\")
n_3 = Slider(4, range=1..100)
on_off_2 = BooleanToggle(False)

# ---- group: main_component
ghpython_script = GhPythonScript(
    beam_divisions=beam_divisions_2,
    population_frame=agent_population_box,
    geometry=geometry.geometry,
    box=example_box,
    Load=on_off,
    Load_mode=list_2,
    l_path=panel_7,
    l_file_name="test_file_name",
    show_save=n,
    latest_save=Toggle(True),
    continue_from=n_2,
    Save=on_off_2,
    s_path=panel_8,
    s_file_name="test_file_name",
    save_every_n=n_3,
    agent_input=agent_input,
    iterations=iterations)  # -> radii_out, probe_points_out, tensions_out, osteoblast_paths_out, osteoclast_paths_out, osteoblast_targets_out, osteoclast_targets_out, ka_model_out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; inputs beam_divisions: Int32, population_frame: Box, geometry: list, box: list, Load: Boolean, Load_mode: Boolean, show_save: Int32, latest_save: Boolean, Save: Boolean, agent_input: list, iterations: Int32
# ---------- ghpython_script: Python ----------
import copy
import System
import rhinoscriptsyntax as rs
import Rhino.Geometry as rg
import ghpythonlib.components as ghc
import clr
clr.AddReferenceToFileAndPath("C:\Program Files\Rhino 6\Plug-ins\Karamba\Karamba.gha")
clr.AddReferenceToFileAndPath("C:\Program Files\Rhino 6\Plug-ins\Karamba\KarambaCommon.dll")
import Karamba as ka
import Karamba.GHopper as kagh
import ghpythonlib.treehelpers as th
import KarambaCommon as kac
import ghpythonlib.treehelpers as th
import math
import cPickle as pickle
import gzip
import os

xy_plane = rg.Plane(rg.Point3d(0,0,0),rg.Point3d(1,0,0),rg.Point3d(0,1,0))
xz_plane = rg.Plane(rg.Point3d(0,0,0),rg.Point3d(1,0,0),rg.Point3d(0,0,1))

# since ironpython doesn't have math.isclose() i need to set my own tolerance for comparisons 
tol = 1e-7

# faktor für die achsenverschiebung von 0 bis 1
shift_factor = 0.2
cluster_limit = 1

# only instantiate model class, when there is no model to be loaded
class xmodel:
    '''object that stores and manages the properties of the geometry to optimize, including the karamba model'''
    
    def __init__(self, lines = None, supports = None, load_pts = None):
        self.probes = []
        self.lines = lines
        self.supports = supports
        self.load_pts = load_pts
        self.frame = population_frame
        self.ka_supports = None
        self.ka_loads = None
        self.ka_elements = None
        self.ka_model = None
        
    def set_geometry(self, geo):
        self.lines = geo[0]
        self.supports = geo[1]
        self.load_pts = geo[2]
        self.load_vectors = geo[3]
    
    def initialize_probes(self):
        # divides fillament into probe points
        points_tmp = []
        for line in self.lines:
            # convert lines to rhino.geometry
            line = rg.LineCurve(line)
            t_temp = line.DivideByCount(beam_divisions-1, True) 
            for t in t_temp:
                points_tmp.append(line.PointAt(t))
        
        for i in range(len(points_tmp)):
            self.probes.append(xprobe_point(points_tmp[i], i, initial_filament_radius))
        
        for j in range(len(self.probes)):
            self.probes[j].determine_node()
            #count_node returns True to increase node counter number for the next node 
            if self.probes[j].count_node() == True:
                global node_counter
                node_counter += 1
            
            self.probes[j].check_if_support()
            self.probes[j].check_if_load_pt()
        
    def update_probe_tensions(self):
        for i in range(len(self.probes)):
            self.probes[i].calc_tension()
        for j in range(len(self.probes)):
            if self.probes[j].node == True:
                self.probes[j].equalize_node() # necessary here?
                #self.probes[i].equalize_node_radii() # necessary here?
        
    def update_probe_positions(self):
        points_tmp = []
        for line in self.lines:
            # convert lines to rhino.geometry
            line = rg.LineCurve(line)
            t_temp = line.DivideByCount(beam_divisions-1, True) 
            for t in t_temp:
                points_tmp.append(line.PointAt(t))
        
        for i in range(len(points_tmp)):
            self.probes[i].point = points_tmp[i]
    
    def update_model_axis(self):
        node_list = []
        new_lines = []
        
        for i in range(node_counter):
            tmp_pts_indices = []
            tmp_pts = None
            for j in range(len(self.probes)):
                if self.probes[j].node == True:
                    # maybe exclude loads and supports here
                    if self.probes[j].node_number == i:
                        tmp_pts_indices.append(j)
            for k in tmp_pts_indices:
                if self.probes[k].point_shifted == None:
                    self.probes[k].point_shifted = self.probes[k].point
                if tmp_pts == None:
                    tmp_pts = self.probes[k].point_shifted
                tmp_pts += self.probes[k].point_shifted
            new_node = tmp_pts/(len(tmp_pts_indices)+1)

            for m in tmp_pts_indices:
                self.probes[m].point = copy.deepcopy(new_node)
        print(len(self.probes))
        for n in range(len(self.probes)):
                if self.probes[n].node == True:
                    node_list.append(n)
        print("s" + str(len(node_list))) ##################
        for o in range(len(node_list)):
            print(node_list[o]) ##################
            if o % 2 == 0:
                new_lines.append(rg.Line(self.probes[node_list[o]].point, self.probes[node_list[o+1]].point))
        self.lines = new_lines
        self.update_probe_positions()
        self.update_probe_tensions()
                
    def reset_cluster_counter(self):
        for i in range(len(model.probes)):
            model.probes[i].targeted = 0
    # there are Karamba.Geometry and Karamba.GHopper.Geometry types for C# and GH envoirenment.  
    # most of the karamba geometry is done with ghpythonlib.components, which just mirrors the grasshopper-component, but still results in Karamba.Geometry.
    # after each function the Karamba.Geometry is converted to Karamba.GHopper.Geometry as required for the ghpythonlib model-assembly.
    # only the model and beam calculation is done within the Karamba.Geometry Namespace
    
    def get_ka_supports(self):
        # getting the points converted to karamba-supports and then to karambaGH-supports
        support_conditions = System.Collections.Generic.List[bool]()
        for i in range(6):
            support_conditions.Add(True)
        supports_tmp = []

        for i in range(node_counter):
            for j in range(len(self.probes)):
                if self.probes[j].support_pt == True and self.probes[j].node_number == i:
                    point_tmp = kagh.Geometry.GeometryExtensions.Convert(self.probes[j].point)
                    plane_tmp = copy.deepcopy(xy_plane)
                    plane_tmp = kagh.Geometry.GeometryExtensions.Convert(plane_tmp)
                    supports_tmp.append(ka.Supports.Support(point_tmp , support_conditions, plane_tmp ))
                    break
        self.ka_supports = [kagh.Supports.GH_Support(x) for x in supports_tmp]
        
    def get_ka_loads(self):
        loads_tmp = []
        #rotation
        #point_tmp = rg.Point3d(0,0,-100)
        #rotation = (100-iterations)*math.pi/180/8
        #point_tmp2 = ghc.Rotate(point_tmp, rotation, xz_plane)[0]
        # annoying conversion from gh to karamba
        f = kagh.Geometry.GeometryExtensions.Convert(rg.Vector3d(0,0,-100))  # originally rg.Vector3d(0,0,-100) for 100 kN
        m = kagh.Geometry.GeometryExtensions.Convert(rg.Vector3d(0,0,0))
        for i in range(node_counter):
            for j in range(len(self.probes)):
                if self.probes[j].load_pt == True and self.probes[j].node_number == i:
                    
                    # when there is an input of manual vector lines
                    if self.load_vectors != None:
                        for k in range(len(self.load_vectors)):
                            if self.load_vectors[k] == self.probes[j].point:
                                if k % 2 == 0:
                                    x = (self.load_vectors[k] - self.load_vectors[k+1])*10
                                else:
                                    x = (self.load_vectors[k] - self.load_vectors[k-1])*10
                                # set the load to 100 kN per Rhino unit for each individual point
                                f = kagh.Geometry.GeometryExtensions.Convert(rg.Vector3d(x))
                                break
                            else:
                                # fix the point to it's position and give it no load
                                f = kagh.Geometry.GeometryExtensions.Convert(rg.Vector3d(0,0,0))
                    
                    # more annoying conversion from gh to karamba
                    ka_point = copy.deepcopy(self.probes[j].point)
                    ka_point = kagh.Geometry.GeometryExtensions.Convert(ka_point)
                    loads_tmp.append(ka.Loads.PointLoad(ka_point, f, m, 0, False))
                    break
        # converting karamba-loads to karambaGH-loads
        self.ka_loads = [kagh.Loads.GH_Load(x) for x in loads_tmp]
        
    def get_ka_elements(self):
        # getting the lines converted to karamba-elements and then to karambaGH-elements
        elements_tmp = ghc.karambaGH.LinetoBeamKaramba3D(self.lines)[0]
        if len(elements_tmp) != len(self.lines):
            print('beam intersection detected') 
        self.ka_elements = [kagh.Elements.GH_Element(x) for x in elements_tmp]
        
    def calc_ka_model(self):
        
        self.get_ka_supports()
        self.get_ka_loads()
        self.get_ka_elements()
        model_tmp = ghc.karambaGH.AssembleModelKaramba3D(elem = self.ka_elements, support = self.ka_supports,  load = self.ka_loads)[0]
        self.ka_model = ka.Algorithms.ThIAnalyze.solve(model_tmp)[4]
        
    def calc_beam_forces(self):
        # returns forces in a list of lists where [0]normal force [1]Mt [2]My [3]Mz for every point
        tmp_list = []
        # creating a list for every point
        for i in range(len(self.probes)):
            tmp_list.append([])
        element_ids = System.Collections.Generic.List[str]()
        for element in self.ka_model.elems:
            element_ids.Add(element.id)
        #loop through elements of model
        tmp_lines_length = [line.Length for line in self.lines]
        model_forces = ka.Results.BeamForces.solve(self.ka_model, element_ids, -1, max(tmp_lines_length), beam_divisions)[0]
        # this whole part is a relic from an earlier version and could be done clearer
        for i in range(len(model_forces)):
            #loop through points on elements
            for j in range(len(model_forces[i])):
                normal_force = model_forces[i][j][0]
                tmp_list[(i*len(model_forces[i])+j)].append(abs(normal_force)) #inverting all negative normal forces(tensile stres) might distort results
                tmp_list[(i*len(model_forces[i])+j)].append(model_forces[i][j][3])
                tmp_list[(i*len(model_forces[i])+j)].append(model_forces[i][j][4])
                tmp_list[(i*len(model_forces[i])+j)].append(model_forces[i][j][5])
        for i in range(len(tmp_list)):
            self.probes[i].forces = tmp_list[i]

class xprobe_point:
    '''object that encapsulates several properties of a fillament probe point'''
    def __init__(self, point, index, radius):
        self.plane = None
        self.point = point
        self.locked = False
        self.support_pt = False
        self.load_pt = False
        self.point_shifted = None
        self.index = index
        self.line_index = int(math.floor(self.index/beam_divisions)) # unsolved problem with indice 0
        self.forces = None
        self.radius = radius
        self.tension = None 
        self.tension_line = None
        self.node = False
        self.node_number = None
        self.targeted = 0
        
    def determine_node (self):
        # check if probe_point is a node
        for i in range(len(model.probes)):
            if self.index != model.probes[i].index and self.point == model.probes[i].point:
                self.node = True
    
    def check_if_support(self):
        
        if self.point in model.supports:
            self.support_pt = True
            self.locked = True
    
    def check_if_load_pt(self):
        
        if self.point in model.load_pts:
            self.load_pt = True
            self.locked = True
    
    def count_node (self):
        #checks for new unseen nodes, assigns current node_count number to all points of the node and returns True to increase node_counter
        for i in range(len(model.probes)):
            if model.probes[i].node_number == None and model.probes[i].node == True:
                node_group_indices = [j.index for j in model.probes if model.probes[i].point == j.point]
                for k in node_group_indices:
                    model.probes[k].node_number = node_counter
                return True
    
    def calc_tension(self):
        self.calc_tension_complete()
        self.calc_tension_lines()
    
    def calc_tension_normal_force(self):
        A = (math.pi * (self.radius ** 2))
        N = self.forces[0]
        self.tension = N/A  # tension is N/A at given probe point (A = pi*r²)
        
    def calc_tension_moment(self):
        M = math.sqrt(self.forces[2]**2+self.forces[3]**2)
        I = (math.pi*self.radius**4)/4
        self.tension = M/I
    
    def calc_tension_complete(self):
        A = (math.pi * (self.radius**2)) # A[cm²] = pi*r²[cm]
        N = self.forces[0] # [kN]
        M = math.sqrt(self.forces[2]**2+self.forces[3]**2)*100 # umrechnung von [kNm] in [kNcm]
        W = (math.pi*((self.radius*2)**3))/32
        self.tension = abs(N/A) + M/W # abs hier richtig?

    
    def get_local_ka_plane(self):
        element = model.ka_elements[int(math.floor(self.index/beam_divisions))]
        # I'm mapping the local coordinate system for each probe point according to a relation i found between karambas "disassemble elemement local coordinate system" and karambas beam forces Mx and My moments
        tmp_plane = ghc.karambaGH.DisassembleElementKaramba3D(element)[6]
        self.plane = rg.Plane(self.point, tmp_plane.ZAxis, rg.Vector3d.Negate(tmp_plane.YAxis))
    
    def calc_tension_lines(self):
        self.get_local_ka_plane()
        point = rg.Point3d(self.forces[2]/30, self.forces[3]/30, 0) # find better solution to scale tension lines/shift factor
        xform = rg.Transform.PlaneToPlane(xy_plane, self.plane)
        point.Transform(xform)
        self.tension_line = rg.Line(self.point ,point)
        
    # assign highest tension to all probe points at a node to prevent agents to get in a tug war over one node with diffrent inherit tesions
    def equalize_node(self):
        
        node_group_indices = [i.index for i in model.probes if self.node_number == i.node_number]
        node_group_tensions = [model.probes[j].tension for j in node_group_indices]
        node_group_radii = [model.probes[j].radius for j in node_group_indices]
        
        for k in node_group_indices:
            model.probes[k].radius = max(node_group_radii)
            model.probes[k].tension = max(node_group_tensions)
            
    # radius transformations to a single point of a node are transfered to the other points
    def equalize_current_node(self): # unused
        self.calc_tension()
        node_group_indices = [i.index for i in model.probes if self.node_number == i.node_number]
        #print(node_group_indices)
        for j in node_group_indices:
            model.probes[j].radius = self.radius
            model.probes[j].calc_tension()
    
    def update_after_shift(self): # old ?
        self.plane = new_plane
        self.point = self.plane.Origin
        self.calc_tension()
        self.equalize_node()



class xagent:
    '''base class for osteoblast and osteoclast''' 
    def __init__(self, point):
        self.point = point
        self.path_record = []
        
    def get_target(self):
        #check for the point with the highest/lowest tension within vision range
        tension_extreme = None
        target_index = None
        vision_tmp = agent_vision_radius
        
        while target_index == None:
            for i in range(len(model.probes)):
                if model.probes[i].targeted < cluster_limit:
                    if self.point.DistanceTo(model.probes[i].point) <= vision_tmp:
                        if self.osteoblast:
                            #osteoblast finding probe point with max tension
                            if tension_extreme == None or tension_extreme < model.probes[i].tension:
                                tension_extreme = model.probes[i].tension
                                target_index = i
                        if self.osteoclast:
                            #prevent osteoclast from freezing by targeting andtrying to decrease a probe point radius below minimum threshold 
                            if model.probes[i].radius > filament_radius_threshold*1.1:
                                #osteoclast finding probe point with min tension
                                if tension_extreme == None or tension_extreme > model.probes[i].tension:
                                    tension_extreme = model.probes[i].tension
                                    target_index = i
            vision_tmp += max_element_length/5
            if vision_tmp >= max_element_length*5 :
                print('infinite loop last bail')
                break
        
        if model.probes[target_index].node == True:
            node_group_indices = [i.index for i in model.probes if model.probes[target_index].node_number == i.node_number]
            for j in node_group_indices:
                model.probes[j].targeted += 1
        else:
            model.probes[target_index].targeted += 1
        return model.probes[target_index].point
        
    def move(self, targetpoint):
        # move agent in the direction of input target according to speed
        temp_move_vec = None
        temp_move_vec_scaled = None
        
        #prevent overshooting the targetpoint
        if self.point.DistanceTo(targetpoint) <= agent_speed:
            self.point = targetpoint
            self.path_record.append(targetpoint)
        #getting movement vector and magnitude from origin to targetpoint
        else:
            temp_move_vec = targetpoint - self.point
            temp_move_vec_scaled = rg.Vector3d.Multiply(temp_move_vec, (agent_speed/temp_move_vec.Length))
            self.point = self.point + temp_move_vec_scaled
            self.path_record.append(self.point)
            
    def get_closest_probe_index(self, originpoint = None):
        if originpoint == None:
            originpoint = self.point
        closest_point_index = None
        for i in range(len(model.probes)):
            if closest_point_index == None or originpoint.DistanceTo(model.probes[i].point) < originpoint.DistanceTo(model.probes[closest_point_index].point):
                closest_point_index = i
        return closest_point_index
        
    def work_closest(self):
        closest = self.get_closest_probe_index()

        # osteoblast increase cross-section radius at nearby probe points
        if self.point.DistanceTo(model.probes[closest].point) <= agent_effect_radius:
            agent_factor = 0
            if self.osteoblast == True:
                agent_factor = 1
            if self.osteoclast == True and model.probes[closest].radius >= filament_radius_threshold:
                agent_factor = -1
            if model.probes[closest].node == True:
                node_group_indices = [i.index for i in model.probes if model.probes[closest].node_number == i.node_number]

                for j in node_group_indices:
                    # the agent factor makes the osteoblast add and the osteoclast remove radius
                    model.probes[j].radius += agent_strength * agent_factor 
                    model.probes[j].calc_tension()
                model.probes[closest].equalize_node()
            else:
                # update the tension for new cross-section
                model.probes[closest].radius += agent_strength * agent_factor
                model.probes[closest].calc_tension()


    def axis_shift(self):
        closest = self.get_closest_probe_index()
        line_index = model.probes[closest].line_index
        t = model.lines[line_index].ClosestParameter(model.probes[closest].point)
        if self.point.DistanceTo(model.probes[closest].point) <= agent_effect_radius:
            # check on which side of the fillament the agent is
            if t > 0.5:
                start = 0
                end = 1
            else:
                start = 1
                end = 0
            rotation_center = model.lines[line_index].PointAt(start)
            rotation_pt = model.lines[line_index].PointAt(end)
            # the probe point at the end of the current fillament is checked for support or load status, in which case it isn't moved
            rotation_probe_index = self.get_closest_probe_index(rotation_pt)
            if model.probes[rotation_probe_index].locked == False:
                rotation_vector1 = rotation_center - model.probes[closest].tension_line.PointAt(0)
                # the shift factor determines the degree of the rotation by moving the axis in the direction of the moment line 
                rotation_vector2 = rotation_center - model.probes[closest].tension_line.PointAt(shift_factor)
                # by rotation from the end to the start of the moment line we achieve a rotation in the opposite direction of the moment
                xform = rg.Transform.Rotation(rotation_vector2, rotation_vector1, rotation_center)
                # find the corresponding probe point at the end of the axis to rotate
                for i in range(len(model.probes)):
                    if line_index == model.probes[i].line_index and rotation_pt == model.probes[i].point:
                        if model.probes[i].point_shifted == None:
                            model.probes[i].point_shifted = copy.deepcopy(model.probes[i].point)
                        model.probes[i].point_shifted.Transform(xform)


    def work_multiple (self):
        for i in range(len(model.probes)):
            if self.point.DistanceTo(model.probes[i].point) <= agent_effect_radius:
                # osteoblast increase cross-section radius at nearby probe points
                if self.osteoblast: 
                    model.probes[i].radius += agent_strength
                 # osteoclast decrease cross-section radius at nearby probe points
                elif model.probes[i].radius >= filament_radius_threshold:
                    model.probes[i].radius -= agent_strength
                #update the tension for new cross-section
                model.probes[i].calculate_tension()



class xosteoblast(xagent):
    '''Agent that moves to areas of highest tension and increases cross-section'''
    osteoblast = True
    osteoclast = False



class xosteoclast(xagent):
    '''Agent that moves to areas of highest tension and increases cross-section'''
    osteoblast = False
    osteoclast = True



class Save_Load:
    
    def __init__(self):
        
        self.loaded_model = []
        self.saved_model = []
    
    
    def save_iteration(self):
        
        # convert geometry and values to a saveable format
        
        lines_txt = model.lines
        supports_txt = model.supports
        load_pts_txt = model.load_pts
        
        probes_txt = []
        
        for i in range(len(model.probes)):
            probe = [] # temporary singular probe array
            probe.append(model.probes[i].plane)
            probe.append(model.probes[i].point)
            probe.append(model.probes[i].locked)
            probe.append(model.probes[i].support_pt)
            probe.append(model.probes[i].load_pt)
            probe.append(model.probes[i].point_shifted)
            probe.append(model.probes[i].index)
            probe.append(model.probes[i].line_index)
            probe.append(model.probes[i].forces)
            probe.append(model.probes[i].radius)
            probe.append(model.probes[i].tension)
            probe.append(model.probes[i].tension_line)
            probe.append(model.probes[i].node)
            probe.append(model.probes[i].node_number)
            probe.append(model.probes[i].targeted)
            
            probes_txt.append(probe) # list of all probes
        
        osteoblasts_txt = []
        for i in range(len(osteoblasts)):
            obs = [] # temporary singular osteoblast array
            obs.append(osteoblasts[i].point)
            obs.append(osteoblasts[i].path_record)
            
            osteoblasts_txt.append(obs) # list of all osteoblasts
        
        osteoclasts_txt = []
        for i in range(len(osteoclasts)):
            ocs = [] # temporary singular osteoclast array
            ocs.append(osteoclasts[i].point)
            ocs.append(osteoclasts[i].path_record)
            
            osteoclasts_txt.append(ocs) # list of all osteoclasts
        
        
        
        # add current iteration to "saved_model"
        
        saved_iteration = []
        
        saved_iteration.append(lines_txt)
        saved_iteration.append(load_pts_txt)
        saved_iteration.append(supports_txt)
        saved_iteration.append(probes_txt)
        saved_iteration.append(osteoblasts_txt)
        saved_iteration.append(osteoclasts_txt)
        saved_iteration.append(node_counter)
        saved_iteration.append(iteration_counter)
        
        self.saved_model.append(saved_iteration)
    
    
    def save_model(self):
        
        if Save:
            #outfile = open(r"{}{}.pkl".format(path,file_name),'wb')
            outfile = gzip.GzipFile(r"{}{}.pkl".format(s_path,s_file_name), 'wb')
            pickle.dump(self.saved_model, outfile)
            outfile.close()
    
    
    def load_model(self):
        
        #infile = open(r"{}{}.pkl".format(path,file_name),'rb')
        infile = gzip.GzipFile(r"{}{}.pkl".format(l_path,l_file_name), 'rb')
        self.loaded_model = pickle.load(infile)
        infile.close()
    
    
    def load_iteration(self, n):
        
        lm = self.loaded_model[n]
        
        # model.lines = lm[0]
        # model.supports = lm[1]
        # model.load_pts = lm[2]
        model.set_geometry([lm[0], lm[1], lm[2]], lm[3])
        
        model.probes = []
        
        #print(lm[3][0][10])
        
        for i in range(len(lm[3])):
            
            model.probes.append(xprobe_point(lm[3][i][1], lm[3][i][6], lm[3][i][9]))
            
            model.probes.append
            model.probes[i].plane = lm[3][i][0] # [3] for the .probe attribute array; [i] for the selected singular probe point; [0] for the .plane attribute
            model.probes[i].point = lm[3][i][1]             #
            model.probes[i].locked = lm[3][i][2]
            model.probes[i].support_pt = lm[3][i][3]
            model.probes[i].load_pt = lm[3][i][4]
            model.probes[i].point_shifted = lm[3][i][5]
            model.probes[i].index = lm[3][i][6]             #
            model.probes[i].line_index = lm[3][i][7]
            model.probes[i].forces = lm[3][i][8]
            model.probes[i].radius = lm[3][i][9]            #
            model.probes[i].tension = lm[3][i][10]
            model.probes[i].tension_line = lm[3][i][11]
            model.probes[i].node = lm[3][i][12]
            model.probes[i].node_number = lm[3][i][13]
            model.probes[i].targeted = lm[3][i][14]
        
        #print(model.probes[0].tension)
        
        for i in range(len(lm[4])):
            osteoblasts.append(xosteoblast(lm[4][i][0]))
            #osteoblasts[i].point = lm[4][i][0]
            osteoblasts[i].path_record = lm[4][i][1]
        
        for i in range(len(lm[5])):
            osteoclasts.append(xosteoclast(lm[5][i][0]))
            #osteoclasts[i].point = lm[5][i][0]
            osteoclasts[i].path_record = lm[5][i][1]
        
        global node_counter
        node_counter = lm[6]
        
        global iteration_counter
        iteration_counter = lm[7]


#############################################################################################################################

# INITIALIZE MODEL

model = xmodel()
if Save or Load:
    saveload = Save_Load()

osteoblasts = []
osteoclasts = []
node_counter = 0

agent_vision_radius_factor = agent_input[0]
agent_effect_radius_factor = agent_input[1]
agent_strength = agent_input[2]
osteoblast_number = agent_input[3]
osteoclast_number = agent_input[4]
seed = agent_input[5]


#############################################################################################################################

if Load:
    # LOAD EXISTING MODEL
    saveload.load_model()
    save_count = len(saveload.loaded_model)
    
    if Load_mode:
        # only analyse model
        if show_save > save_count:
            show_save = save_count
            save_count = str(save_count) + " ##"
        saveload.load_iteration(show_save - 1)
        calc = False
    else:
        # continue processing        
        if latest_save:
            # continue from latest save step
            saveload.load_iteration(len(saveload.loaded_model)-1)
        else:
            # continue from n
            saveload.load_iteration(continue_from-1)
        calc = True
else:
    # INSTANTIATE NEW MODEL
    if geometry[0]:
        # from Input
        model.set_geometry(geometry)
    else:
        # example box if no input given
        model.set_geometry(box[0:3])
        model.population_frame = rg.Box(rg.Plane(rg.Point3d(0,0,0),rg.Point3d(1,0,0),rg.Point3d(0,1,0)), [rg.Point3d(0,0,0), rg.Point3d(box[3], box[4], box[5])])
    iteration_counter = 0
    calc = True

elements_length = [i.Length for i in model.lines]
max_element_length = math.ceil(max(elements_length))

initial_filament_radius = max_element_length / 0.5
filament_radius_threshold = initial_filament_radius / 5  # danger: if the threshold is larger than the initial radius move() will produce an infinite loop
agent_vision_radius = max_element_length * agent_vision_radius_factor / 2 # <3
agent_effect_radius = agent_vision_radius * agent_effect_radius_factor / 3.5
agent_speed = max_element_length / 10

if not Load:
    model.initialize_probes()
    # initialize agent startpoints
    osteoclast_points = ghc.Populate3D(model.frame, osteoclast_number, seed)
    osteoblast_points = ghc.Populate3D(model.frame, osteoblast_number, seed+1)
    
    if type(osteoblast_points) is rg.Point3d:
        # ensure to get a list for a single agent to prevent type errors
        osteoblast_points = [osteoblast_points]  
    for i in range(osteoblast_number):
        osteoblasts.append(xosteoblast(osteoblast_points[i]))
    
    # initialize osteoclast instances
    
    if type(osteoclast_points) is rg.Point3d:
        # ensure to get a list for a single agent to prevent type errors
        osteoclast_points = [osteoclast_points] 
    for i in range(osteoclast_number):
        osteoclasts.append(xosteoclast(osteoclast_points[i]))

if calc:
    # CALCULATE MODEL
    model.calc_ka_model()
    model.calc_beam_forces()
    model.update_probe_tensions()
    
    if Save and Load:
        # set loaded_model list as origin for save_model list
        saveload.saved_model = saveload.loaded_model
    
    # cycle through iterations
    for i in range(iterations):
        for j in range(osteoblast_number):
            osteoblasts[j].move(osteoblasts[j].get_target())
            osteoblasts[j].work_closest()
            osteoblasts[j].axis_shift()
        for k in range(osteoclast_number):
            osteoclasts[k].move(osteoclasts[k].get_target())
            osteoclasts[k].work_closest()
            osteoclasts[k].axis_shift()
        model.reset_cluster_counter()
        model.update_model_axis()
        model.calc_ka_model()
        model.calc_beam_forces()
        print(iteration_counter)
        
        iteration_counter += 1
        
        # save every n iteration
        if Save and (i+1) % save_every_n == 0:
            print("saved at iteration " + str(iteration_counter))
            saveload.save_iteration()
    
    if Save:
        # SAVE CURRENT MODEL
        saveload.save_model()

#############################################################################################################################

# OUTPUTS

radii_out = []
probe_points_out = []
tensions_out = []
tension_lines_out = []

for i in range(len(model.probes)):
    radii_out.append(model.probes[i].radius)
    probe_points_out.append(model.probes[i].point)
    tensions_out.append(model.probes[i].tension)
    tension_lines_out.append(model.probes[i].tension_line)

probe_points_out = th.list_to_tree(probe_points_out)

#export osteoblasts
osteoblast_targets_out = []
osteoblast_paths_out = []

for i in range(osteoblast_number):
    osteoblast_paths_out.append(osteoblasts[i].path_record)
    osteoblast_targets_out.append(osteoblasts[i].get_target())
osteoblast_paths_out = th.list_to_tree(osteoblast_paths_out)
osteoblast_targets_out =th.list_to_tree(osteoblast_targets_out)


#export osteoclasts
osteoclast_targets_out = []
osteoclast_paths_out = []
for i in range(osteoclast_number):
    osteoclast_paths_out.append(osteoclasts[i].path_record)
    osteoclast_targets_out.append(osteoclasts[i].get_target())
osteoclast_paths_out = th.list_to_tree(osteoclast_paths_out)
osteoclast_targets_out =th.list_to_tree(osteoclast_targets_out)

if calc:
    ka_model_out = ka.GHopper.Models.GH_Model(model.ka_model)
    ka_supports_out = model.ka_supports
    ka_elements_out = model.ka_elements
    load_pts_out = model.load_pts

if Load:
    load_data = " Save states available:  {}\n Loaded iteration:       {}".format(str(save_count), str(iteration_counter))
else:
    load_data = " Save states available:     off\n Loaded iteration:          off"

if Save:
    save_data = " Save states:  {}".format(str(len(saveload.saved_model)))
else:
    save_data = " Save states: off"
# ---------- end ghpython_script ----------

# ----
# OR
panel_9 = Panel(ghpython_script.load_data)

panel_10 = Panel(ghpython_script.save_data)

# ----
# karamba cross-section optimization
number_slider_3 = Slider(150, range=0..200)
negative = Negative(Value=number_slider_3)
unit_z = UnitZ(Factor=negative)
cross_section_range_selector_karamba3d = CrossSectionRangeSelectorKaramba3D(MaximumHeight_cm=-1, MaximumWidth_cm=-1, menu=[dropdown(1), dropdown(2), dropdown(1)])
loads_karamba3d = LoadsKaramba3D(ForceVector=unit_z, Local=False, PosInd=ghpython_script.load_pts_out, LCase=0, mode="Point")
assemble_model_karamba3d = AssembleModelKaramba3D(
    Elem=ghpython_script.ka_elements_out,
    Support=ghpython_script.ka_supports_out,
    Load=loads_karamba3d,
    CrossSection=cross_section_range_selector_karamba3d,
    LimitDistance_m=0.005)  # -> Model, Info, Mass_kg, CenterOfGravity
optimize_cross_section_karamba3d = OptimizeCrossSectionKaramba3D(
    Model=assemble_model_karamba3d.Model,
    CrossSections=cross_section_range_selector_karamba3d,
    MaximumUtilization=1,
    MaximumDisplacement_cm=-1,
    UltimateLimitStateIterations=5,
    DisplacementIterations=5,
    NumberOfSamplePoints=3,
    ElasticDesign=True,
    GammaM0=1,
    GammaM1=1)  # -> ModelWithOptimizedCrossSections, Info, Mass_kg, MaximumDisplacement_cm, ElasticEnergy_kNm
analyze_karamba3d = AnalyzeKaramba3D(Model=assemble_model_karamba3d.Model)  # -> CalculatedModel, MaximumDisplacement_cm, ResultingForceOfGravity_kN, ElasticEnergy_kNm
beam_view_karamba3d = BeamViewKaramba3D(Model=optimize_cross_section_karamba3d.ModelWithOptimizedCrossSections)  # -> Model, MeshesOfRenderedBeams, DeformedBeamAxes, LegendColors, LegendTags

text_baker = TextBaker(
    Location=ghpython_script.probe_points_out,
    Text=ghpython_script.tensions_out,
    Size=Slider(0.1, range=0..0.1),
    Justification=6,
    Bake=False)

panel_11 = Panel(ghpython_script.probe_points_out)

data = Data(ghpython_script.ka_model_out)
model_view_karamba3d = ModelViewKaramba3D(Model=data, ResultFactors=1, ResultCase=-1)  # -> Model, DeformedMesh, DeformedAxes, DeformedModel
beam_view_karamba3d_2 = BeamViewKaramba3D(Model=model_view_karamba3d.Model)  # -> Model, MeshesOfRenderedBeams, DeformedBeamAxes, LegendColors, LegendTags
curve = Curve(beam_view_karamba3d_2.DeformedBeamAxes)
dispatch = Dispatch(List=curve, DispatchPattern=[True, False])  # -> ListA, ListB; disabled

# ---- group: stress distribution
# min | max
# average
bar_graph = BarGraph(ghpython_script.tensions_out, BarColor=RGB(255, 0, 90))
quick_graph = QuickGraph(ghpython_script.tensions_out, SortOrder=0)
bounds = Bounds(Numbers=ghpython_script.tensions_out)
mass_addition = MassAddition(Input=ghpython_script.tensions_out)  # -> Result, PartialResults
panel_12 = Panel(bounds)
list_length = ListLength(List=ghpython_script.tensions_out)
division = Division(A=mass_addition.Result, B=list_length)
panel_13 = Panel(division)

# ----
index = ItemIndex(List=ghpython_script.tensions_out, Item=ghpython_script.tensions_out)

# ---- group: moment distribution
length = Length(Curve=ghpython_script.tension_lines_out)
bar_graph_2 = BarGraph(length, BarColor=RGB(255, 0, 90))
bounds_2 = Bounds(Numbers=length)
quick_graph_2 = QuickGraph(length, SortOrder=0)
panel_14 = Panel(bounds_2)
mass_addition_2 = MassAddition(Input=length)  # -> Result, PartialResults
list_length_2 = ListLength(List=length)
division_2 = Division(A=mass_addition_2.Result, B=list_length_2)
# known errors/missing:
# 
# EQUAL LOAD DISTRIBUTION
# uneven distribution of probe points(depending on lenght)
# wrong index number first line
# simultanious update?
# material application trough area not radius
# killing groups(?)
# geometry input
# equalibrium calculation <- galapagos optimization
# achsverschiebung
# agent targetpoint considering distance(?)
# joints with multipipe
# agent balance research
# constant material (?)
# no target in range error
# vision, speed, area_of_ effect and scale koppeln
# animation with changing loads
# initialize agents on probe_points
# recalculate ka_model with ever shorter intervals
# train neural net by inputting only the graph and the forces
# temporarily increase vision if out of range
# shift permanently active
# no target error
panel_15 = Panel(division_2)

# ----
sort = SortList(Keys=ghpython_script.tensions_out, ValuesA=index)  # -> Keys, ValuesA
lng_3 = ListLength(List=ghpython_script.probe_points_out)
panel_16 = Panel(sort.ValuesA)
panel_17 = Panel(sort.Keys)
item_3 = ListItem(List=ghpython_script.probe_points_out, Index=Slider(429, range=0..1000), Wrap=True)
item_4 = ListItem(List=ghpython_script.probe_points_out, Index=Slider(164, range=0..300), Wrap=True)
panel_19 = Panel(lng_3)
panel_20 = Panel(item_3)
sph = Sphere(Base=item_4, Radius=1)

# ---- group: moment lines
curve_2 = Curve(ghpython_script.tension_lines_out)
custom_preview_lineweights = CustomPreviewLineweights(Geometry=curve_2, Shader=ColourSwatch(SwatchColor=RGB(255, 129, 0)), Absolute=False)

# ----
python = GhPythonScript(
    beam_divisions=beam_divisions_2,
    tensions=ghpython_script.tensions_out,
    max_value=Slider(0.55, range=0..20),
    min_value=Slider(0.1, range=0..1))  # -> flatten(color_spheres), flatten(color_beams), stress; inputs tensions: list
# ---------- python: Python ----------
from statistics import mean 

span = max_value - min_value
color_factor = 255 / span
color_spheres = []
color_beams = []
counter = 0
temp = []

#test
stress = []


for i in range(len(tensions)):
    
    if tensions[i] > max_value:
        tensions[i] = max_value
    
    if tensions[i] < min_value:
        tensions[i] = min_value
    
    stress_level = (tensions[i] - min_value) * color_factor
    
    R = int(stress_level)
    G = 255 - R
    
    if stress_level < 128:
        color_spheres.append(str(R) + ", 255, 0")
    else:
        color_spheres.append("255, " + str(G) + ", 0")
    
    if counter == beam_divisions - 1:
        R = int(mean(temp))
        G = 255 - R
        
        stress.append(stress_level)
        if stress_level < 128:
            color_beams.append(str(R) + ", 255, 0")
        else:
            color_beams.append("255, " + str(G) + ", 0")
        
        temp = []
        counter = 0
    
    else:
        temp.append(R)
        counter += 1

print(len(color_spheres))
print(color_spheres[0])
# ---------- end python ----------

# ---- group: pipe_visualisation
number_slider_4 = Slider(0.1, range=0..1)
division_3 = Division(A=ghpython_script.radii_out, B=Slider(50, range=0..100))
range = Range(Domain=Domain(0, 1), Steps=expr("x-1", beam_divisions_2))
partition_list = PartitionList(List=ghpython_script.probe_points_out, Size=beam_divisions_2)  # -> simplify(Chunks)
partition_list_2 = PartitionList(List=division_3, Size=beam_divisions_2)  # -> simplify(Chunks)
polyline = PolyLine(Vertices=partition_list, Closed=False)
python_2 = GhPythonScript(x=partition_list_2, min_radius=number_slider_4, max_radius=number_slider_2)  # -> out, a; inputs x: list
# ---------- python_2: Python ----------
__author__ = "SKIKK"
__version__ = "2022.12.15"

import rhinoscriptsyntax as rs

a= x

for i in range(len(x)):
    if x[i] < min_radius:
        a[i] = min_radius
    if x[i] > max_radius:
        a[i] = max_radius
# ---------- end python_2 ----------
pipe_variable = PipeVariable(Curve=reparameterize(polyline), Parameters=range, Radii=python_2.a, Caps=0)  # -> flatten(Pipe)
custom_preview_materials = CustomPreviewMaterials(Geometry=pipe_variable, DiffuseColor=python.color_beams)

# ---- group: node spheres
point = Point(ghpython_script.probe_points_out)
list_length_3 = ListLength(List=point)
series = Series(Start=0, Step=beam_divisions_2, Count=list_length_3)
division_4 = Division(A=ghpython_script.radii_out, B=Slider(50, range=0..100))
python_3 = GhPythonScript(x=division_4, min_radius=number_slider_4, max_radius=number_slider_2)  # -> out, a; inputs x: list; same code as python_2
sphere = Sphere(Base=point, Radius=python_3.a)
list_item = ListItem(List=sphere, Index=series, Wrap=False)
# done:
# 
# highest tension on nodes
# vision and effect
# karamba search type List(Str)
# 3D
custom_preview_materials_2 = CustomPreviewMaterials(Geometry=list_item, DiffuseColor=python.color_spheres)

# ----
panel_21 = Panel(partition_list_2)
panel_22 = Panel(python_2.a)
panel_23 = Panel(python.stress)
# pfad | spannung | fläche
# bewegungsvektoramplituden = spannung/durschnittsspannung. wenn also  ein osteoblast an einer stelle ist, wo insgesamt mehr null-items + unterdurchschnittliche vectoren sind, bekommt er einen nullvektor und stirbt. warum?
# was wird hier korrigiert?
# hier wird normalisiert. warum?
# pfad | spannung | fläche
mesh = Mesh(beam_view_karamba3d.MeshesOfRenderedBeams)

# ---- group: osteoclast
C = ColourSwatch(SwatchColor=RGB(0, 0, 255))
B = ColourSwatch(SwatchColor=RGB(0, 255, 255))
point_2 = Point(ghpython_script.osteoclast_paths_out)
C_2 = ColourSwatch(SwatchColor=RGB(0, 0, 255))
range_2 = Range(Domain=Domain(0, 1), Steps=ghpython_script.iteration_counter)
list_item_2 = ListItem(List=point_2, Index=0, Wrap=True)  # -> Item1, Item
col = Colour([C, B])
col_2 = Colour(C_2)
interp = InterpolateData(Data=point_2, Parameter=range_2, Interpolation=1)
interp_2 = InterpolateData(Data=col, Parameter=range_2, Interpolation=2)
number_slider_5 = Slider(0.8, range=0..1)
C_3 = ColourSwatch(SwatchColor=RGB(0, 0, 255))
col_3 = Colour(C_3)

# ----
xz_plane = XZPlane(Origin=list_item_2.Item1)

# ---- group: osteoclast / target
preview = CustomPreview(Geometry=ghpython_script.osteoclast_targets_out, Material=col_2)

# ---- group: osteoclast / affect
sphere_2 = Sphere(Base=xz_plane, Radius=ghpython_script.agent_effect_radius)
circle = Circle(Plane=xz_plane, Radius=ghpython_script.agent_effect_radius)

# ---- group: osteoclast / vision
sphere_3 = Sphere(Base=xz_plane, Radius=ghpython_script.agent_vision_radius)
circle_2 = Circle(Plane=xz_plane, Radius=ghpython_script.agent_vision_radius)

# ----
preview_2 = CustomPreview(Geometry=circle, Material=col_3)

# ---- group: osteoclast / vision
custom_preview_materials_3 = CustomPreviewMaterials(Geometry=sphere_3, DiffuseColor=col_3, Transparency=number_slider_5)

# ---- group: osteoclast (continued)
custom_preview_materials_4 = CustomPreviewMaterials(Geometry=sphere_2, DiffuseColor=col_3, Transparency=number_slider_5)

# ---- group: osteoclast / effect
preview_3 = CustomPreview(Geometry=circle_2, Material=col_3)

# ---- group: osteoclast / path
preview_4 = CustomPreview(Geometry=interp, Material=interp_2)

# ---- group: osteoblast
point_3 = Point(ghpython_script.osteoblast_paths_out)
B_2 = ColourSwatch(SwatchColor=RGB(255, 255, 0))
C_4 = ColourSwatch(SwatchColor=RGB(255, 0, 0))
C_5 = ColourSwatch(SwatchColor=RGB(255, 0, 0))
list_item_3 = ListItem(List=point_3, Index=0, Wrap=True)  # -> Item1, Item
range_3 = Range(Domain=Domain(0, 1), Steps=ghpython_script.iteration_counter)
col_4 = Colour([C_4, B_2])
xz_plane_2 = XZPlane(Origin=list_item_3.Item1)
col_5 = Colour(C_5)
interp_3 = InterpolateData(Data=col_4, Parameter=range_3, Interpolation=2)
interp_4 = InterpolateData(Data=point_3, Parameter=range_3, Interpolation=1)
number_slider_6 = Slider(0.8, range=0..1)
C_6 = ColourSwatch(SwatchColor=RGB(255, 0, 0))
col_6 = Colour(C_6)

# ---- group: osteoblast / target
preview_5 = CustomPreview(Geometry=ghpython_script.osteoblast_targets_out, Material=col_5)

# ---- group: osteoblast / vision
sphere_4 = Sphere(Base=xz_plane_2, Radius=ghpython_script.agent_vision_radius)
circle_3 = Circle(Plane=xz_plane_2, Radius=ghpython_script.agent_vision_radius)

# ---- group: osteoblast / effect
sphere_5 = Sphere(Base=xz_plane_2, Radius=ghpython_script.agent_effect_radius)
circle_4 = Circle(Plane=xz_plane_2, Radius=ghpython_script.agent_effect_radius)

# ---- group: osteoblast (continued)
custom_preview_materials_5 = CustomPreviewMaterials(Geometry=sphere_5, DiffuseColor=col_6, Transparency=number_slider_6)
preview_6 = CustomPreview(Geometry=circle_3, Material=col_6)

# ---- group: osteoblast / vision
custom_preview_materials_6 = CustomPreviewMaterials(Geometry=sphere_4, DiffuseColor=col_6, Transparency=number_slider_6)

# ---- group: osteoblast / path
preview_7 = CustomPreview(Geometry=interp_4, Material=interp_3)

# ---- group: osteoblast / effect
preview_8 = CustomPreview(Geometry=circle_4, Material=col_6)
