# Grasshopper definition artificial_ossification_pickle_data.gh (Grasshopper 1.0.7)
# plug-ins: Heteroptera, VoxelTools, Human, Kangaroo2 Components, karambaGH

support_surfaces = Surface(<surface referenced from the Rhino model>)
load_surfaces = Surface([<surface referenced from the Rhino model> x3])
stairs = Brep(<brep referenced from the Rhino model>)
box = DomainBox(Base=PlaneXY(0, 0, 0), X=Slider(20, range=0..30), Y=Slider(10, range=0..30), Z=Slider(15, range=0..30))
box_2 = Box(box)
debrep = DeconstructBrep(Brep=box_2)  # -> Faces, Edges, Vertices
brep = Brep(stairs)
top = ListItem(List=debrep.Faces, Index="5", Wrap=True)
bot = ListItem(List=debrep.Faces, Index="4", Wrap=True)
pop3d = Populate3D(Region=box_2, Count=Slider(13, range=1..20), Seed=Slider(5, range=1..20))
Z = UnitZ(Factor=Slider(-0.01, range=-0.01..0))
Z_2 = UnitZ(Factor=Slider(-0.01, range=-0.01..0))
voronoi³ = Voronoi3D(Points=pop3d, Box=box_2)  # -> Cells, Boundary
box_3 = Box(brep)
division = Division(A=Z, B=-2)
extr = Extrude(Base=top, Direction=Z)
division_2 = Division(A=Z_2, B=-2)
extr_2 = Extrude(Base=bot, Direction=Z_2)
pop3d_2 = Populate3D(Region=box_3, Count=Slider(10, range=0..1000), Seed=Slider(49, range=0..100))
debrep_2 = DeconstructBrep(Brep=voronoi³.Cells)  # -> Faces, Edges, Vertices
rdlines = RemoveDuplicateLinesKaramba3D(Line=flatten(debrep_2.Edges), LimitDistance=0.005)  # -> OutLine, Info, Indexes
cullpt = CullDuplicates(Points=flatten(debrep_2.Vertices), Tolerance=".001", CullMode=3)  # -> flatten(Points), Indices, Valence
move = Move(Geometry=extr, Motion=division)  # -> Geometry, Transform
move_2 = Move(Geometry=extr_2, Motion=division_2)  # -> Geometry, Transform
pop3d_3 = Populate3D(Region=brep, Count=Slider(5, range=1..100), Seed=Slider(54, range=1..100))
voronoi³_2 = Voronoi3D(Points=pop3d_2, Box=box_3)  # -> Cells, Boundary
brepsinc = PointInBreps(Brep=move.Geometry, Point=cullpt.Points, Strict=False)  # -> Inside, Index
brepsinc_2 = PointInBreps(Brep=move_2.Geometry, Point=cullpt.Points, Strict=False)  # -> Inside, Index
brepinc = PointInBrep(Brep=brep, Point=pop3d_3, Strict=False)
sint = SolidIntersection(BrepsA=voronoi³_2.Cells, BrepsB=brep)
dispatch = Dispatch(List=cullpt.Points, DispatchPattern=brepsinc.Inside)  # -> ListA, ListB
dispatch_2 = Dispatch(List=cullpt.Points, DispatchPattern=brepsinc_2.Inside)  # -> ListA, ListB
dispatch_3 = Dispatch(List=pop3d_3, DispatchPattern=brepinc)  # -> ListA, ListB
edges = BrepEdges(Brep=brep)  # -> Naked, Interior, NonManifold
edges_2 = BrepEdges(Brep=sint)  # -> Naked, Interior, NonManifold
midpt = CurveMiddle(Curve=edges.Interior)

# ---- group: Test Inputs
frame = Box(box_2)
load_pts = Point(dispatch.ListA)
supports = Point(dispatch_2.ListA)
lines = Curve(rdlines.OutLine)

# ----
crv = Curve(flatten(edges_2.Interior))
pt = Point(flatten([dispatch_3.ListA, midpt]))

# ---- group: just cut brep out of voronoi box
dupln = RemoveDuplicateLines(Lines=crv, Tolerance=0.01)

# ----
voronoi³_3 = Voronoi3D(Points=pt, Box=box_3)  # -> Cells, Boundary
con = DelaunayEdges(Points=pt, Plane=PlaneXY(0, 0, 0))  # -> Connectivity, Edges
del = DelaunayMesh(Points=pt, Plane=PlaneXY(0, 0, 0))
sint_2 = SolidIntersection(BrepsA=voronoi³_3.Cells, BrepsB=brep)
edges_3 = BrepEdges(Brep=sint_2)  # -> Naked, Interior, NonManifold
crv_2 = Curve(flatten(edges_3.Interior))

# ---- group: sort of based on brep edges
rdlines_2 = RemoveDuplicateLinesKaramba3D(Line=dupln, LimitDistance=0.005)  # -> OutLine, Info, Indexes
dupln_2 = RemoveDuplicateLines(Lines=crv_2, Tolerance=0.01)

# ----
Z_3 = UnitZ(Factor=Slider(-0.01, range=-0.01..0))
Z_4 = UnitZ(Factor=Slider(-0.01, range=-0.01..0))
srf = Surface(load_surfaces)
srf_2 = Surface(support_surfaces)
end = EndPoints(Curve=rdlines_2.OutLine)  # -> Start, End
division_3 = Division(A=Z_3, B=-2)
extr_3 = Extrude(Base=srf, Direction=Z_3)
division_4 = Division(A=Z_4, B=-2)
extr_4 = Extrude(Base=srf_2, Direction=Z_4)
cullpt_2 = CullDuplicates(Points=flatten([end.Start, end.End]), Tolerance=".001", CullMode=3)  # -> Points, Indices, Valence
move_3 = Move(Geometry=extr_3, Motion=division_3)  # -> Geometry, Transform
move_4 = Move(Geometry=extr_4, Motion=division_4)  # -> Geometry, Transform
brepsinc_3 = PointInBreps(Brep=move_3.Geometry, Point=cullpt_2.Points, Strict=False)  # -> Inside, Index
brepsinc_4 = PointInBreps(Brep=move_4.Geometry, Point=cullpt_2.Points, Strict=False)  # -> Inside, Index
dispatch_4 = Dispatch(List=cullpt_2.Points, DispatchPattern=brepsinc_3.Inside)  # -> ListA, ListB
dispatch_5 = Dispatch(List=cullpt_2.Points, DispatchPattern=brepsinc_4.Inside)  # -> ListA, ListB
supports_2 = Point(flatten(dispatch_5.ListA))
load_pts_2 = Point(flatten(dispatch_4.ListA))
number_slider = Slider(5, range=1..5)
brep_2 = Brep(brep)
box_4 = Box(box_3)
voxcreate = CreateVoxelGrid(BoundingBox=box_4, SizeX=number_slider, SizeY=number_slider, SizeZ=number_slider)
voxgeo = VoxelateGeometry(Geometry=brep_2, VoxelGrid=voxcreate, Distance=0)
voxbox = VoxelGridToBoxes(VoxelGrid=voxgeo, Selection=1)  # -> Boxes, Points
edges_4 = BrepEdges(Brep=voxbox.Boxes)  # -> Naked, Interior, NonManifold
crv_3 = Curve(flatten(edges_4.Interior))
dupln_3 = RemoveDuplicateLines(Lines=crv_3, Tolerance=0.1)
end_2 = EndPoints(Curve=dupln_3)  # -> Start, End
bbox = BoundingBox(Content=flatten(dupln_3), Plane=PlaneXY(0, 0, 0), UnionBox=True)  # -> Box, Box_2
panel = Panel("""0
1
2
3""")
debrep_3 = DeconstructBrep(Brep=bbox.Box)  # -> Faces, Edges, Vertices
item = ListItem(List=debrep_3.Vertices, Index=panel, Wrap=True)
pt_2 = Point(flatten([end_2.Start, end_2.End, item]))
cullpt_3 = CullDuplicates(Points=pt_2, Tolerance=0.1, CullMode=3)  # -> Points, Indices, Valence

# ---- group: Stairs Model
entwine = Entwine(Branch0X=load_pts_2, Branch1X=supports_2, Branch2X=rdlines_2.OutLine, Branch3X=box_3, FlattenInputs=False)

# ---- group: Test Model
entwine_2 = Entwine(Branch0X=load_pts, Branch1X=supports, Branch2X=lines, Branch3X=frame, FlattenInputs=False)

# ----
brep_3 = Brep([<brep referenced from the Rhino model> x3])
pdecon = Deconstruct(Point=cullpt_3.Points)  # -> XComponent, YComponent, ZComponent
python = GhPythonScript(Dump=Button())  # unedited script template
python_2 = GhPythonScript(Read=Button())  # -> out; unedited script template
brepsinc_5 = PointInBreps(Brep=brep_3, Point=cullpt_3.Points, Strict=False)  # -> Inside, Index
c_script = CSharpScript(X=pdecon.XComponent, Y=pdecon.YComponent, Z=pdecon.ZComponent)  # -> A; inputs X: list of Double, Y: list of Double, Z: list of Double
# ---------- c_script: C# ----------
    A = X.Count;
    //for (int i = 0; i < X.Count; i++)
# ---------- end c_script ----------
dispatch_6 = Dispatch(List=cullpt_3.Points, DispatchPattern=brepsinc_5.Inside)  # -> ListA, ListB
pt_3 = Point(dispatch_6.ListA)

# ---- group: Grid Infill Stairs
entwine_3 = Entwine(Branch0X=pt_3, Branch1X=item, Branch2X=dupln_3, Branch3X=bbox.Box, FlattenInputs=False)

# ---- group: Inputs
bang = ExplodeTree(Data=entwine_3)  # -> flatten(Branch0), flatten(Branch1), flatten(Branch2), flatten(Branch3)

# ----
number_slider_2 = Slider(4, range=0..20)
iterations = Slider(3, range=0..20000)

data_recorder = DataRecorder(Button(), DataLimit=-10, RecordData=True)
data_recorder_2 = DataRecorder(Button(), DataLimit=-10, RecordData=True)
list_length = ListLength(List=flatten(data_recorder))  # -> expr("Max(0, (x-1)\2)", Length)
list_length_2 = ListLength(List=flatten(data_recorder_2))  # -> expr("Max(0, (x-1)\2)", Length)
addition = Addition(A=iterations, B=list_length)
subtraction = Subtraction(A=addition, B=list_length_2)

show_loaded_model_at_below_iteration = BooleanToggle(False)
seed = Slider(308, range=20..1031)
n = Slider(1, range=1..100)
n_2 = Slider(1, range=1..100)

# ---- group: main_component
osteoclast_blast_number = Slider(10, range=0..100)
agent_vision_radius_factor = Slider(2, range=0..2)
agent_effect_radius_factor = Slider(1, range=0..2)
agent_strength = Slider(0.9, range=0..1)
load = BooleanToggle(False)
save = BooleanToggle(False)
ghpython_script = GhPythonScript(
    beam_divisions=number_slider_2,
    agent_vision_radius_factor=agent_vision_radius_factor,
    agent_effect_radius_factor=agent_effect_radius_factor,
    osteoblast_number=osteoclast_blast_number,
    osteoclast_number=osteoclast_blast_number,
    agent_strength=agent_strength,
    iterations=subtraction,
    seed=seed,
    imported_load_pts=bang.Branch0,
    imported_supports=bang.Branch1,
    imported_lines=bang.Branch2,
    imported_frame=bang.Branch3,
    save_every_n=n,
    Save=save,
    load_at_save_n=n_2,
    Load=load,
    show_model=show_loaded_model_at_below_iteration,
    path="C:\University\3. Semester\Artificial Ossification\json\",
    file_name="test_run")  # -> save_count_out, out, radii_out, probe_points_out, tensions_out, osteoblast_paths_out, osteoclast_paths_out, osteoblast_targets_out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; inputs beam_divisions: Int32, osteoblast_number: Int32, osteoclast_number: Int32, iterations: Int32, imported_load_pts: list of Point3d, imported_supports: list of Point3d, imported_lines: list of Line, imported_frame: Box, save_every_n: Int32, load_at_save_n: Int32
# ---------- ghpython_script: Python ----------
__author__ = "Rolf"
__version__ = "2021.08.03"

import copy
import System
import rhinoscriptsyntax as rs
import Rhino.Geometry as rg
import ghpythonlib.components as ghc
import clr
clr.AddReferenceToFileAndPath("C:\Program Files\Rhino 6\Plug-ins\Karamba\Karamba.gha")
clr.AddReferenceToFileAndPath("C:\Program Files\Rhino 6\Plug-ins\Karamba\KarambaCommon.dll")
import Karamba as ka
import Karamba.GHopper as kagh
import ghpythonlib.treehelpers as th
import KarambaCommon as kac
import ghpythonlib.treehelpers as th
import math
import time
import pickle
import cPickle
from pprint import pprint

xy_plane = rg.Plane(rg.Point3d(0,0,0),rg.Point3d(1,0,0),rg.Point3d(0,1,0))
xz_plane = rg.Plane(rg.Point3d(0,0,0),rg.Point3d(1,0,0),rg.Point3d(0,0,1))

# since ironpython doesn't have math.isclose() i need to set my own tolerance for comparisons 
tol = 1e-7

# faktor für die achsenverschiebung von 0 bis 1
shift_factor = 0.2
cluster_limit = 1

test_line = []
test_pt = []

# if Load: load existing model
if Load:
    # get pickle file
    infile = open(r"{}{}.pkl".format(path,file_name),'rb')
    loaded = cPickle.load(infile)
    # tell the amount of saves in the pickle file to make it easier to load the correct model
    save_count = "Available savestates on current model: " + str(len(loaded))
    print(save_count)
    # if requested savestate doesn't exist
    if load_at_save_n > len(loaded):
        # make it the latest possible savestate
        load_at_save_n = len(loaded) + 1
    # load model of savestate n
    loaded_model = loaded[int(load_at_save_n - 1)]
    
    # equal all loaded inputs with the necessary parameters
    l_probes = []
    l_lines = loaded_model[0]
    l_load_pts = loaded_model[1]
    l_probes = loaded_model[2]
    l_supports = loaded_model[3]
    l_volume = loaded_model[4]
    iteration_start = loaded_model[5]
    osteoblasts = loaded_model[6]
    osteoclasts = loaded_model[7]
    node_counter = loaded_model[8]

# only instantiate model class, when there is no model to be loaded
class xmodel:
    '''object that stores and manages the properties of the geometry to optimize, including the karamba model'''
    
    def __init__(self, lines = None, frame = None, load_pts = None, supports = None):
        
        # if Load: equal all loaded inputs with the necessary parameters
        if Load:
            self.lines = l_lines
            self.load_pts = l_load_pts
            self.probes = l_probes
            self.supports = l_supports
            self.volume = l_volume
        
        # else: generate new model as usual
        else:
            self.save_count = "No model loaded."
            self.probes = []
            self.lines = lines
            self.frame = frame
            self.load_pts = load_pts
            self.supports = supports
            #if self.lines == None and self.frame == None and self.load_pts == None and self.supports == None:
            self.init_voronoi(imported_load_pts, imported_supports)
        self.ka_supports = None
        self.ka_loads = None
        self.ka_elements = None
        self.ka_model = None
        
    def init_voronoi(self, imported_load_pts, imported_supports):
        self.load_pts = imported_load_pts
        self.supports = imported_supports
        self.lines = imported_lines
        
        self.volume = True
        self.frame = imported_frame
    
    def initialize_probes(self):
        # divides fillament into probe points
        points_tmp = []
        for line in self.lines:
            # convert lines to rhino.geometry
            line = rg.LineCurve(line)
            t_temp = line.DivideByCount(beam_divisions-1, True) 
            for t in t_temp:
                points_tmp.append(line.PointAt(t))
        
        for i in range(len(points_tmp)):
            self.probes.append(xprobe_point(points_tmp[i], i, initial_filament_radius))
        
        for j in range(len(self.probes)):
            self.probes[j].determine_node()
            #count_node returns True to increase node counter number for the next node 
            if self.probes[j].count_node() == True:
                global node_counter
                node_counter += 1
            
            self.probes[j].check_if_support()
            self.probes[j].check_if_load_pt()
        
    def update_probe_tensions(self):
        for i in range(len(self.probes)):
            self.probes[i].calc_tension()
        for j in range(len(self.probes)):
            if self.probes[j].node == True:
                self.probes[j].equalize_node() # necessary here?
                #self.probes[i].equalize_node_radii() # necessary here?
        
    def update_probe_positions(self):
        points_tmp = []
        for line in self.lines:
            # convert lines to rhino.geometry
            line = rg.LineCurve(line)
            t_temp = line.DivideByCount(beam_divisions-1, True) 
            for t in t_temp:
                points_tmp.append(line.PointAt(t))
        
        for i in range(len(points_tmp)):
            self.probes[i].point = points_tmp[i]
    
    def update_model_axis(self):
        global test_pt
        node_list = []
        new_lines = []
        
        for i in range(node_counter):
            tmp_pts_indices = []
            tmp_pts = None
            for j in range(len(self.probes)):
                if self.probes[j].node == True:
                    # maybe exclude loads and supports here
                    if self.probes[j].node_number == i:
                        tmp_pts_indices.append(j)
            for k in tmp_pts_indices:
                if self.probes[k].point_shiftet == None:
                    self.probes[k].point_shiftet = self.probes[k].point
                if tmp_pts == None:
                    tmp_pts = self.probes[k].point_shiftet
                tmp_pts += self.probes[k].point_shiftet
            new_node = tmp_pts/(len(tmp_pts_indices)+1)
            test_pt=new_node

            for m in tmp_pts_indices:
                self.probes[m].point = copy.deepcopy(new_node)
                
        for n in range(len(self.probes)):
                if self.probes[n].node == True:
                    node_list.append(n)
        for o in range(len(node_list)):
            if o % 2 == 0:
                new_lines.append(rg.Line(self.probes[node_list[o]].point, self.probes[node_list[o+1]].point))
        self.lines = new_lines
        self.update_probe_positions()
        self.update_probe_tensions()
                
    def reset_cluster_counter(self):
        for i in range(len(model.probes)):
            model.probes[i].targeted = 0
    # there are Karamba.Geometry and Karamba.GHopper.Geometry types for C# and GH envoirenment.  
    # most of the karamba geometry is done with ghpythonlib.components, which just mirrors the grasshopper-component, but still results in Karamba.Geometry.
    # after each function the Karamba.Geometry is converted to Karamba.GHopper.Geometry as required for the ghpythonlib model-assembly.
    # only the model and beam calculation is done within the Karamba.Geometry Namespace
    
    def get_ka_supports(self):
        # getting the points converted to karamba-supports and then to karambaGH-supports
        support_conditions = System.Collections.Generic.List[bool]()
        for i in range(6):
            support_conditions.Add(True)
        supports_tmp = []

        for i in range(node_counter):
            for j in range(len(self.probes)):
                if self.probes[j].support_pt == True and self.probes[j].node_number == i:
                    point_tmp = kagh.Geometry.GeometryExtensions.Convert(self.probes[j].point)
                    plane_tmp = copy.deepcopy(xy_plane)
                    plane_tmp = kagh.Geometry.GeometryExtensions.Convert(plane_tmp)
                    supports_tmp.append(ka.Supports.Support(point_tmp , support_conditions, plane_tmp ))
                    break
        self.ka_supports = [kagh.Supports.GH_Support(x) for x in supports_tmp]
        
    def get_ka_loads(self):
        loads_tmp = []
        #rotation
        #point_tmp = rg.Point3d(0,0,-100)
        #rotation = (100-iterations)*math.pi/180/8
        #point_tmp2 = ghc.Rotate(point_tmp, rotation, xz_plane)[0]
        # annoying conversion from gh to karamba
        f = kagh.Geometry.GeometryExtensions.Convert(rg.Vector3d(0,0,-100))  # originally rg.Vector3d(0,0,-100) for 100 kN
        m = kagh.Geometry.GeometryExtensions.Convert(rg.Vector3d(0,0,0))
        for i in range(node_counter):
            for j in range(len(self.probes)):
                if self.probes[j].load_pt == True and self.probes[j].node_number == i:
                    # more annoying conversion from gh to karamba
                    ka_point = copy.deepcopy(self.probes[j].point)
                    ka_point = kagh.Geometry.GeometryExtensions.Convert(ka_point)
                    loads_tmp.append(ka.Loads.PointLoad(ka_point, f, m, 0, False))
                    break
        # converting karamba-loads to karambaGH-loads
        self.ka_loads = [kagh.Loads.GH_Load(x) for x in loads_tmp]
        
    def get_ka_elements(self):
        # getting the lines converted to karamba-elements and then to karambaGH-elements
        elements_tmp = ghc.karambaGH.LinetoBeamKaramba3D(self.lines)[0]
        if len(elements_tmp) != len(self.lines):
            print('beam intersection detected') 
        self.ka_elements = [kagh.Elements.GH_Element(x) for x in elements_tmp]
        
    def calc_ka_model(self):
        
        self.get_ka_supports()
        self.get_ka_loads()
        self.get_ka_elements()
        model_tmp = ghc.karambaGH.AssembleModelKaramba3D(elem = self.ka_elements, support = self.ka_supports,  load = self.ka_loads)[0]
        self.ka_model = ka.Algorithms.ThIAnalyze.solve(model_tmp)[4]
        
    def calc_beam_forces(self):
        # returns forces in a list of lists where [0]normal force [1]Mt [2]My [3]Mz for every point
        tmp_list = []
        # creating a list for every point
        for i in range(len(self.probes)):
            tmp_list.append([])
        element_ids = System.Collections.Generic.List[str]()
        for element in self.ka_model.elems:
            element_ids.Add(element.id)
        #loop through elements of model
        tmp_lines_length = [line.Length for line in self.lines]
        model_forces = ka.Results.BeamForces.solve(self.ka_model, element_ids, -1, max(tmp_lines_length), beam_divisions)[0]
        # this whole part is a relic from an earlier version and could be done clearer
        for i in range(len(model_forces)):
            #loop through points on elements
            for j in range(len(model_forces[i])):
                normal_force = model_forces[i][j][0]
                tmp_list[(i*len(model_forces[i])+j)].append(abs(normal_force)) #inverting all negative normal forces(tensile stres) might distort results
                tmp_list[(i*len(model_forces[i])+j)].append(model_forces[i][j][3])
                tmp_list[(i*len(model_forces[i])+j)].append(model_forces[i][j][4])
                tmp_list[(i*len(model_forces[i])+j)].append(model_forces[i][j][5])
        for i in range(len(tmp_list)):
            self.probes[i].forces = tmp_list[i]

class xprobe_point:
    '''object that encapsulates several properties of a fillament probe point'''
    def __init__(self, point, index, radius):
        self.plane = None
        self.point = point
        self.locked = False
        self.support_pt = False
        self.load_pt = False
        self.point_shiftet = None
        self.index = index
        self.line_index = int(math.floor(self.index/beam_divisions)) # unsolved problem with indice 0
        self.forces = None
        self.radius = radius
        self.tension = None 
        self.tension_line = None
        self.node = False
        self.node_number = None
        self.targeted = 0
        
    def determine_node (self):
        # check if probe_point is a node
        for i in range(len(model.probes)):
            if self.index != model.probes[i].index and self.point == model.probes[i].point:
                self.node = True
    
    def check_if_support(self):
        
        if self.point in model.supports:
            self.support_pt = True
            self.locked = True
    
    def check_if_load_pt(self):
        
        if self.point in model.load_pts:
            self.load_pt = True
            self.locked = True
    
    def count_node (self):
        #checks for new unseen nodes, assigns current node_count number to all points of the node and returns True to increase node_counter
        for i in range(len(model.probes)):
            if model.probes[i].node_number == None and model.probes[i].node == True:
                node_group_indices = [j.index for j in model.probes if model.probes[i].point == j.point]
                for k in node_group_indices:
                    model.probes[k].node_number = node_counter
                return True
    
    def calc_tension(self):
        self.calc_tension_complete()
        self.calc_tension_lines()
    
    def calc_tension_normal_force(self):
        A = (math.pi * (self.radius ** 2))
        N = self.forces[0]
        self.tension = N/A  # tension is N/A at given probe point (A = pi*r²)
        
    def calc_tension_moment(self):
        M = math.sqrt(self.forces[2]**2+self.forces[3]**2)
        I = (math.pi*self.radius**4)/4
        self.tension = M/I
    
    def calc_tension_complete(self):
        A = (math.pi * (self.radius**2)) # A[cm²] = pi*r²[cm]
        #print(self.index)
        #print(self.point)
        #print(len(self.forces))
        N = self.forces[0] # [kN]
        M = math.sqrt(self.forces[2]**2+self.forces[3]**2)*100 # umrechnung von [kNm] in [kNcm]
        W = (math.pi*((self.radius*2)**3))/32
        self.tension = abs(N/A) + M/W # abs hier richtig?

    
    def get_local_ka_plane(self):
        element = model.ka_elements[int(math.floor(self.index/beam_divisions))]
        # I'm mapping the local coordinate system for each probe point according to a relation i found between karambas "disassemble elemement local coordinate system" and karambas beam forces Mx and My moments
        tmp_plane = ghc.karambaGH.DisassembleElementKaramba3D(element)[6]
        self.plane = rg.Plane(self.point, tmp_plane.ZAxis, rg.Vector3d.Negate(tmp_plane.YAxis))
    
    def calc_tension_lines(self):
        self.get_local_ka_plane()
        point = rg.Point3d(self.forces[2]/30, self.forces[3]/30, 0) # find better solution to scale tension lines/shift factor
        xform = rg.Transform.PlaneToPlane(xy_plane, self.plane)
        point.Transform(xform)
        self.tension_line = rg.Line(self.point ,point)
        
    # assign highest tension to all probe points at a node to prevent agents to get in a tug war over one node with diffrent inherit tesions
    def equalize_node(self):
        
        node_group_indices = [i.index for i in model.probes if self.node_number == i.node_number]
        node_group_tensions = [model.probes[j].tension for j in node_group_indices]
        node_group_radii = [model.probes[j].radius for j in node_group_indices]
        
        for k in node_group_indices:
            model.probes[k].radius = max(node_group_radii)
            model.probes[k].tension = max(node_group_tensions)
            
    # radius transformations to a single point of a node are transfered to the other points
    def equalize_current_node(self): # unused
        self.calc_tension()
        node_group_indices = [i.index for i in model.probes if self.node_number == i.node_number]
        #print(node_group_indices)
        for j in node_group_indices:
            model.probes[j].radius = self.radius
            model.probes[j].calc_tension()
    
    def update_after_shift(self): # old ?
        self.plane = new_plane
        self.point = self.plane.Origin
        self.calc_tension()
        self.equalize_node()



class xagent:
    '''base class for osteoblast and osteoclast''' 
    def __init__(self, point):
        self.point = point
        self.path_record = []
        
    def get_target(self):
        #check for the point with the highest/lowest tension within vision range
        tension_extreme = None
        target_index = None
        vision_tmp = agent_vision_radius
        
        while target_index == None:
            for i in range(len(model.probes)):
                if model.probes[i].targeted < cluster_limit:
                    if self.point.DistanceTo(model.probes[i].point) <= vision_tmp:
                        if self.osteoblast:
                            #osteoblast finding probe point with max tension
                            if tension_extreme == None or tension_extreme < model.probes[i].tension:
                                tension_extreme = model.probes[i].tension
                                target_index = i
                        if self.osteoclast:
                            #prevent osteoclast from freezing by targeting andtrying to decrease a probe point radius below minimum threshold 
                            if model.probes[i].radius > filament_radius_threshold*1.1:
                                #osteoclast finding probe point with min tension
                                if tension_extreme == None or tension_extreme > model.probes[i].tension:
                                    tension_extreme = model.probes[i].tension
                                    target_index = i
            vision_tmp += max_element_length/5
            if vision_tmp >= max_element_length*5 :
                print('infinite loop last bail')
                break
        
        if model.probes[target_index].node == True:
            node_group_indices = [i.index for i in model.probes if model.probes[target_index].node_number == i.node_number]
            for j in node_group_indices:
                model.probes[j].targeted += 1
        else:
            model.probes[target_index].targeted += 1
        return model.probes[target_index].point
        
    def move(self, targetpoint):
        # move agent in the direction of input target according to speed
        temp_move_vec = None
        temp_move_vec_scaled = None
        
        #prevent overshooting the targetpoint
        if self.point.DistanceTo(targetpoint) <= agent_speed:
            self.point = targetpoint
            self.path_record.append(targetpoint)
        #getting movement vector and magnitude from origin to targetpoint
        else:
            temp_move_vec = targetpoint - self.point
            temp_move_vec_scaled = rg.Vector3d.Multiply(temp_move_vec, (agent_speed/temp_move_vec.Length))
            self.point = self.point + temp_move_vec_scaled
            self.path_record.append(self.point)
            
    def get_closest_probe_index(self, originpoint = None):
        if originpoint == None:
            originpoint = self.point
        closest_point_index = None
        for i in range(len(model.probes)):
            if closest_point_index == None or originpoint.DistanceTo(model.probes[i].point) < originpoint.DistanceTo(model.probes[closest_point_index].point):
                closest_point_index = i
        return closest_point_index
        
    def work_closest(self):
        closest = self.get_closest_probe_index()

        # osteoblast increase cross-section radius at nearby probe points
        if self.point.DistanceTo(model.probes[closest].point) <= agent_effect_radius:
            agent_factor = 0
            if self.osteoblast == True:
                agent_factor = 1
            if self.osteoclast == True and model.probes[closest].radius >= filament_radius_threshold:
                agent_factor = -1
            if model.probes[closest].node == True:
                node_group_indices = [i.index for i in model.probes if model.probes[closest].node_number == i.node_number]

                for j in node_group_indices:
                    # the agent factor makes the osteoblast add and the osteoclast remove radius
                    model.probes[j].radius += agent_strength * agent_factor 
                    model.probes[j].calc_tension()
                model.probes[closest].equalize_node()
            else:
                # update the tension for new cross-section
                model.probes[closest].radius += agent_strength * agent_factor
                model.probes[closest].calc_tension()

    
    def axis_shift(self):
        global test_line 
        closest = self.get_closest_probe_index()
        line_index = model.probes[closest].line_index
        t = model.lines[line_index].ClosestParameter(model.probes[closest].point)
        if self.point.DistanceTo(model.probes[closest].point) <= agent_effect_radius:
            # check on which side of the fillament the agent is
            if t > 0.5:
                start = 0
                end = 1
            else:
                start = 1
                end = 0
            rotation_center = model.lines[line_index].PointAt(start)
            rotation_pt = model.lines[line_index].PointAt(end)
            # the probe point at the end of the current fillament is checked for support or load status, in which case it isn't moved
            rotation_probe_index = self.get_closest_probe_index(rotation_pt)
            if model.probes[rotation_probe_index].locked == False:
                rotation_vector1 = rotation_center - model.probes[closest].tension_line.PointAt(0)
                # the shift factor determines the degree of the rotation by moving the axis in the direction of the moment line 
                rotation_vector2 = rotation_center - model.probes[closest].tension_line.PointAt(shift_factor)
                # by rotation from the end to the start of the moment line we achieve a rotation in the opposite direction of the moment
                xform = rg.Transform.Rotation(rotation_vector2, rotation_vector1, rotation_center)
                # find the corresponding probe point at the end of the axis to rotate
                for i in range(len(model.probes)):
                    if line_index == model.probes[i].line_index and rotation_pt == model.probes[i].point:
                        if model.probes[i].point_shiftet == None:
                            model.probes[i].point_shiftet = copy.deepcopy(model.probes[i].point)
                        model.probes[i].point_shiftet.Transform(xform)

                        test_line= []
                        test_line.append(rg.Line(model.probes[closest].tension_line.PointAt(0),model.probes[closest].tension_line.PointAt(shift_factor)))
                        test_line.append(rg.Line(model.probes[i].point, model.probes[i].point_shiftet))

        
    def work_multiple (self):
        for i in range(len(model.probes)):
            if self.point.DistanceTo(model.probes[i].point) <= agent_effect_radius:
                # osteoblast increase cross-section radius at nearby probe points
                if self.osteoblast: 
                    model.probes[i].radius += agent_strength
                 # osteoclast decrease cross-section radius at nearby probe points
                elif model.probes[i].radius >= filament_radius_threshold:
                    model.probes[i].radius -= agent_strength
                #update the tension for new cross-section
                model.probes[i].calculate_tension()

class xosteoblast(xagent):
    '''Agent that moves to areas of highest tension and increases cross-section'''
    osteoblast = True
    osteoclast = False


class xosteoclast(xagent):
    '''Agent that moves to areas of highest tension and increases cross-section'''
    osteoblast = False
    osteoclast = True

# INITIALIZE MODEL

model = xmodel()


elements_length = [i.Length for i in model.lines]
max_element_length = math.ceil(max(elements_length))

initial_filament_radius = max_element_length / 0.5
filament_radius_threshold = initial_filament_radius / 5  # danger: if the threshold is larger than the initial radius move() will produce an infinite loop
agent_vision_radius = max_element_length * agent_vision_radius_factor / 2 # <3
agent_effect_radius = agent_vision_radius * agent_effect_radius_factor / 3.5
agent_speed = max_element_length / 10

# skip if model loaded, because all probes should be defined already
if not Load:
    osteoblasts = []
    osteoclasts = []
    node_counter = 0
    iteration_start = 0
    model.initialize_probes()

model.calc_ka_model()
model.calc_beam_forces()
model.update_probe_tensions()

# skip if model loaded, because all agents should be defined as well
if not Load:
    
    # initialize agent startpoints
    
    if model.volume == True:
        osteoclast_points = ghc.Populate3D(model.frame, osteoclast_number, seed)
        osteoblast_points = ghc.Populate3D(model.frame, osteoblast_number, seed+1)
    else:
        osteoclast_points = ghc.Populate2D(model.frame, osteoclast_number, seed)
        osteoblast_points = ghc.Populate2D(model.frame, osteoblast_number, seed+1)
    
    # initialize osteoblast instances
    
    if type(osteoblast_points) is rg.Point3d:
        # ensure to get a list for a single agent to prevent type errors
        osteoblast_points = [osteoblast_points]  
    for i in range(osteoblast_number):
        osteoblasts.append(xosteoblast(osteoblast_points[i]))
    
    # initialize osteoclast instances
    
    if type(osteoclast_points) is rg.Point3d:
        # ensure to get a list for a single agent to prevent type errors
        osteoclast_points = [osteoclast_points] 
    for i in range(osteoclast_number):
        osteoclasts.append(xosteoclast(osteoclast_points[i]))


input = []              # input list for saving later
save_counter = 0        # set counter for saving every n iteration
current_iteration = 0   # set counter for documenting the iteration progress


# skip if show_model is on to freeze the processing and show the loaded iteration
if not show_model:
    
    # put agents to work
    
    for i in range(iterations):
        print('iteration' + str(i))
        for j in range(osteoblast_number):
            osteoblasts[j].move(osteoblasts[j].get_target())
            osteoblasts[j].work_closest()
            osteoblasts[j].axis_shift()
        for k in range(osteoclast_number):
            osteoclasts[k].move(osteoclasts[k].get_target())
            osteoclasts[k].work_closest()
            osteoclasts[k].axis_shift()
        model.reset_cluster_counter()
        model.update_model_axis()
        model.calc_ka_model()
        model.calc_beam_forces()
        
        # iteration progress
        current_iteration = i+1
        saved_iteration = iteration_start + current_iteration
        
        # get all important model data into the 'input'-list every n iterations
        if Save:
            save_counter += 1
            if save_counter >= save_every_n:
                saved_model = []
                
                saved_model.append(model.lines) # 0
                saved_model.append(model.load_pts) # 1
                saved_model.append(model.probes) # 2
                saved_model.append(model.supports) # 3
                saved_model.append(model.volume) # 4
                saved_model.append(saved_iteration) # 5
                saved_model.append(osteoblasts) # 6
                saved_model.append(osteoclasts) # 7
                saved_model.append(node_counter) # 8
                #saved_model.append(model.ka_elements) # 9
                #saved_model.append(model.ka_loads) # 10
                #saved_model.append(model.ka_model) # 11
                #saved_model.append(model.ka_supports) # 12
                
                input.append(saved_model)
                save_counter = 0

#for i in range(len(model.ka_loads)):
    #input.append(ka.GHopper.Loads.GH_Load.ToString(model.ka_loads[i]))
    #input.append(ka.GHopper.Loads.GH_Load.Write(model.ka_loads[i], GH_IWriter))

#print(type(model.ka_loads[0]))
#print(model.ka_loads)
#print(type(osteoblasts))
#print(input[5])
#pprint(dir(model))
#pprint(vars(model))

#print(input)

# save all models in pickle file
if Save:
    outfile = open(r"{}{}.pkl".format(path,file_name),'wb')
    pickle.dump(input, outfile)
    outfile.close()

# OUTPUTS


radii_out = []
probe_points_out = []
tensions_out = []
tension_lines_out = []
planes_out = []

for i in range(len(model.probes)):
    radii_out.append(model.probes[i].radius)
    probe_points_out.append(model.probes[i].point)
    tensions_out.append(model.probes[i].tension)
    tension_lines_out.append(model.probes[i].tension_line)
    planes_out.append(model.probes[i].plane)

probe_points_out = th.list_to_tree(probe_points_out)

#export osteoblasts
osteoblast_targets_out = []
osteoblast_paths_out = []
for i in range(osteoblast_number):
    osteoblast_paths_out.append(osteoblasts[i].path_record)
    osteoblast_targets_out.append(osteoblasts[i].get_target())
osteoblast_paths_out = th.list_to_tree(osteoblast_paths_out)


#export osteoclasts
osteoclast_targets_out = []
osteoclast_paths_out = []
for i in range(osteoclast_number):
    osteoclast_paths_out.append(osteoclasts[i].path_record)
    osteoclast_targets_out.append(osteoclasts[i].get_target())
osteoclast_paths_out = th.list_to_tree(osteoclast_paths_out)
osteoclast_targets_out =th.list_to_tree(osteoclast_targets_out)


ka_model_out = ka.GHopper.Models.GH_Model(model.ka_model)
ka_supports_out = model.ka_supports
ka_loads_out = model.ka_loads
ka_elements_out = model.ka_elements
load_pts_out = model.load_pts

lines_out = model.lines
save_count_out = model.save_count
# ---------- end ghpython_script ----------

# ----
# karamba cross-section optimization
number_slider_3 = Slider(150, range=0..200)
negative = Negative(Value=number_slider_3)
unit_z = UnitZ(Factor=negative)
cross_section_range_selector_karamba3d = CrossSectionRangeSelectorKaramba3D(MaximumHeight_cm=-1, MaximumWidth_cm=-1, menu=[dropdown(1), dropdown(2), dropdown(1)])
loads_karamba3d = LoadsKaramba3D(ForceVector=unit_z, Local=False, PosInd=ghpython_script.load_pts_out, LCase=0, mode="Point")
assemble_model_karamba3d = AssembleModelKaramba3D(
    Elem=ghpython_script.ka_elements_out,
    Support=ghpython_script.ka_supports_out,
    Load=loads_karamba3d,
    CrossSection=cross_section_range_selector_karamba3d,
    LimitDistance_m=0.005)  # -> Model, Info, Mass_kg, CenterOfGravity
optimize_cross_section_karamba3d = OptimizeCrossSectionKaramba3D(
    Model=assemble_model_karamba3d.Model,
    CrossSections=cross_section_range_selector_karamba3d,
    MaximumUtilization=1,
    MaximumDisplacement_cm=-1,
    UltimateLimitStateIterations=5,
    DisplacementIterations=5,
    NumberOfSamplePoints=3,
    ElasticDesign=True,
    GammaM0=1,
    GammaM1=1)  # -> ModelWithOptimizedCrossSections, Info, Mass_kg, MaximumDisplacement_cm, ElasticEnergy_kNm
analyze_karamba3d = AnalyzeKaramba3D(Model=assemble_model_karamba3d.Model)  # -> CalculatedModel, MaximumDisplacement_cm, ResultingForceOfGravity_kN, ElasticEnergy_kNm
beam_view_karamba3d = BeamViewKaramba3D(Model=optimize_cross_section_karamba3d.ModelWithOptimizedCrossSections)  # -> Model, MeshesOfRenderedBeams, DeformedBeamAxes, LegendColors, LegendTags

text_baker = TextBaker(
    Location=ghpython_script.probe_points_out,
    Text=ghpython_script.tensions_out,
    Size=Slider(0.1, range=0..0.1),
    Justification=6,
    Bake=False)

point = Point(ghpython_script.test_pt)
panel_2 = Panel(ghpython_script.save_count_out)

data = Data(ghpython_script.ka_model_out)
model_view_karamba3d = ModelViewKaramba3D(Model=data, ResultFactors=1, ResultCase=-1)  # -> Model, DeformedMesh, DeformedAxes, DeformedModel
beam_view_karamba3d_2 = BeamViewKaramba3D(Model=model_view_karamba3d.Model)  # -> Model, MeshesOfRenderedBeams, DeformedBeamAxes, LegendColors, LegendTags
curve = Curve(beam_view_karamba3d_2.DeformedBeamAxes)
dispatch_7 = Dispatch(List=curve, DispatchPattern=[True, False])  # -> ListA, ListB; disabled

panel_3 = Panel(ghpython_script.input)

# ---- group: stress distribution
# min | max
# average
bar_graph = BarGraph(ghpython_script.tensions_out, BarColor=RGB(255, 0, 90))
quick_graph = QuickGraph(ghpython_script.tensions_out, SortOrder=0)
bounds = Bounds(Numbers=ghpython_script.tensions_out)
mass_addition = MassAddition(Input=ghpython_script.tensions_out)  # -> Result, PartialResults
panel_4 = Panel(bounds)
list_length_3 = ListLength(List=ghpython_script.tensions_out)
division_5 = Division(A=mass_addition.Result, B=list_length_3)
panel_5 = Panel(division_5)

# ---- group: moment distribution
length = Length(Curve=ghpython_script.tension_lines_out)
bar_graph_2 = BarGraph(length, BarColor=RGB(255, 0, 90))
bounds_2 = Bounds(Numbers=length)
quick_graph_2 = QuickGraph(length, SortOrder=0)
panel_6 = Panel(bounds_2)
mass_addition_2 = MassAddition(Input=length)  # -> Result, PartialResults
list_length_4 = ListLength(List=length)
division_6 = Division(A=mass_addition_2.Result, B=list_length_4)
# known errors/missing:
# 
# EQUAL LOAD DISTRIBUTION
# uneven distribution of probe points(depending on lenght)
# wrong index number first line
# simultanious update?
# material application trough area not radius
# killing groups(?)
# geometry input
# equalibrium calculation <- galapagos optimization
# achsverschiebung
# agent targetpoint considering distance(?)
# joints with multipipe
# agent balance research
# constant material (?)
# no target in range error
# vision, speed, area_of_ effect and scale koppeln
# animation with changing loads
# initialize agents on probe_points
# recalculate ka_model with ever shorter intervals
# train neural net by inputting only the graph and the forces
# temporarily increase vision if out of range
# shift permanently active
# no target error
panel_7 = Panel(division_6)

# ----
panel_8 = Panel(ghpython_script.loaded)
item_2 = ListItem(List=ghpython_script.probe_points_out, Index=Slider(429, range=0..1000), Wrap=True)
panel_9 = Panel(item_2)

# ---- group: moment lines
curve_2 = Curve(ghpython_script.tension_lines_out)
custom_preview_lineweights = CustomPreviewLineweights(Geometry=curve_2, Shader=ColourSwatch(SwatchColor=RGB(255, 129, 0)), Absolute=False)

# ----
number_slider_4 = Slider(0.6, range=0..1)

# ---- group: pipe_visualisation
number_slider_5 = Slider(0.1, range=0..1)
division_7 = Division(A=ghpython_script.radii_out, B=Slider(50, range=0..100))
range = Range(Domain=Domain(0, 1), Steps=expr("x-1", number_slider_2))
partition_list = PartitionList(List=ghpython_script.probe_points_out, Size=number_slider_2)  # -> simplify(Chunks)
partition_list_2 = PartitionList(List=division_7, Size=number_slider_2)  # -> simplify(Chunks)
polyline = PolyLine(Vertices=partition_list, Closed=False)
python_3 = GhPythonScript(x=partition_list_2, min_radius=number_slider_5, max_radius=number_slider_4)  # -> out, a; inputs x: list
# ---------- python_3: Python ----------
__author__ = "SKIKK"
__version__ = "2022.12.15"

import rhinoscriptsyntax as rs

a= x

for i in range(len(x)):
    if x[i] < min_radius:
        a[i] = min_radius
    if x[i] > max_radius:
        a[i] = max_radius
# ---------- end python_3 ----------
pipe_variable = PipeVariable(Curve=reparameterize(polyline), Parameters=range, Radii=python_3.a, Caps=0)
custom_preview_materials = CustomPreviewMaterials(Geometry=pipe_variable, DiffuseColor=RGB(255, 255, 255))

# ---- group: node spheres
point_2 = Point(ghpython_script.probe_points_out)
list_length_5 = ListLength(List=point_2)
series = Series(Start=0, Step=number_slider_2, Count=list_length_5)
division_8 = Division(A=ghpython_script.radii_out, B=Slider(50, range=0..100))
python_4 = GhPythonScript(x=division_8, min_radius=number_slider_5, max_radius=number_slider_4)  # -> out, a; inputs x: list; same code as python_3
sphere = Sphere(Base=point_2, Radius=python_4.a)
list_item = ListItem(List=sphere, Index=series, Wrap=False)
# done:
# 
# highest tension on nodes
# vision and effect
# karamba search type List(Str)
# 3D
custom_preview_materials_2 = CustomPreviewMaterials(Geometry=list_item, DiffuseColor=RGB(255, 255, 255))

# ----
panel_10 = Panel(partition_list_2)
panel_11 = Panel(python_3.a)
# pfad | spannung | fläche
# bewegungsvektoramplituden = spannung/durschnittsspannung. wenn also  ein osteoblast an einer stelle ist, wo insgesamt mehr null-items + unterdurchschnittliche vectoren sind, bekommt er einen nullvektor und stirbt. warum?
# was wird hier korrigiert?
# hier wird normalisiert. warum?
# pfad | spannung | fläche
mesh = Mesh(beam_view_karamba3d.MeshesOfRenderedBeams)

# ---- group: osteoclast
C = ColourSwatch(SwatchColor=RGB(0, 0, 255))
B = ColourSwatch(SwatchColor=RGB(0, 255, 255))
point_3 = Point(ghpython_script.osteoclast_paths_out)
C_2 = ColourSwatch(SwatchColor=RGB(0, 0, 255))
range_2 = Range(Domain=Domain(0, 1), Steps=subtraction)
list_item_2 = ListItem(List=point_3, Index=0, Wrap=True)  # -> Item1, Item
col = Colour([C, B])
col_2 = Colour(C_2)
interp = InterpolateData(Data=point_3, Parameter=range_2, Interpolation=1)
interp_2 = InterpolateData(Data=col, Parameter=range_2, Interpolation=2)
number_slider_6 = Slider(0.8, range=0..1)
C_3 = ColourSwatch(SwatchColor=RGB(0, 0, 255))
col_3 = Colour(C_3)

# ----
xz_plane = XZPlane(Origin=list_item_2.Item1)

# ---- group: osteoclast / target
preview = CustomPreview(Geometry=ghpython_script.osteoclast_targets_out, Material=col_2)

# ---- group: osteoclast / affect
sphere_2 = Sphere(Base=xz_plane, Radius=ghpython_script.agent_effect_radius)
circle = Circle(Plane=xz_plane, Radius=ghpython_script.agent_effect_radius)

# ---- group: osteoclast / vision
sphere_3 = Sphere(Base=xz_plane, Radius=ghpython_script.agent_vision_radius)
circle_2 = Circle(Plane=xz_plane, Radius=ghpython_script.agent_vision_radius)

# ----
preview_2 = CustomPreview(Geometry=circle, Material=col_3)

# ---- group: osteoclast (continued)
custom_preview_materials_3 = CustomPreviewMaterials(Geometry=sphere_2, DiffuseColor=col_3, Transparency=number_slider_6)

# ---- group: osteoclast / vision
custom_preview_materials_4 = CustomPreviewMaterials(Geometry=sphere_3, DiffuseColor=col_3, Transparency=number_slider_6)

# ---- group: osteoclast / effect
preview_3 = CustomPreview(Geometry=circle_2, Material=col_3)

# ---- group: osteoclast / path
preview_4 = CustomPreview(Geometry=interp, Material=interp_2)

# ---- group: osteoblast
point_4 = Point(ghpython_script.osteoblast_paths_out)
B_2 = ColourSwatch(SwatchColor=RGB(255, 255, 0))
C_4 = ColourSwatch(SwatchColor=RGB(255, 0, 0))
C_5 = ColourSwatch(SwatchColor=RGB(255, 0, 0))
list_item_3 = ListItem(List=point_4, Index=0, Wrap=True)  # -> Item1, Item
range_3 = Range(Domain=Domain(0, 1), Steps=subtraction)
col_4 = Colour([C_4, B_2])
xz_plane_2 = XZPlane(Origin=list_item_3.Item1)
col_5 = Colour(C_5)
interp_3 = InterpolateData(Data=col_4, Parameter=range_3, Interpolation=2)
interp_4 = InterpolateData(Data=point_4, Parameter=range_3, Interpolation=1)
number_slider_7 = Slider(0.8, range=0..1)
C_6 = ColourSwatch(SwatchColor=RGB(255, 0, 0))
col_6 = Colour(C_6)

# ---- group: osteoblast / target
preview_5 = CustomPreview(Geometry=ghpython_script.osteoblast_targets_out, Material=col_5)

# ---- group: osteoblast / vision
sphere_4 = Sphere(Base=xz_plane_2, Radius=ghpython_script.agent_vision_radius)
circle_3 = Circle(Plane=xz_plane_2, Radius=ghpython_script.agent_vision_radius)

# ---- group: osteoblast / effect
sphere_5 = Sphere(Base=xz_plane_2, Radius=ghpython_script.agent_effect_radius)
circle_4 = Circle(Plane=xz_plane_2, Radius=ghpython_script.agent_effect_radius)

# ---- group: osteoblast (continued)
custom_preview_materials_5 = CustomPreviewMaterials(Geometry=sphere_5, DiffuseColor=col_6, Transparency=number_slider_7)
preview_6 = CustomPreview(Geometry=circle_3, Material=col_6)

# ---- group: osteoblast / vision
custom_preview_materials_6 = CustomPreviewMaterials(Geometry=sphere_4, DiffuseColor=col_6, Transparency=number_slider_7)

# ---- group: osteoblast / path
preview_7 = CustomPreview(Geometry=interp_4, Material=interp_3)

# ---- group: osteoblast / effect
preview_8 = CustomPreview(Geometry=circle_4, Material=col_6)
