# Grasshopper definition Artificial_Ossification.gh (Grasshopper 1.0.7)
# plug-ins: Heteroptera, VoxelTools, Human, Kangaroo2 Components, karambaGH

support_surfaces = Surface(<surface referenced from the Rhino model>)
load_surfaces = Surface([<surface referenced from the Rhino model> x3])
stairs = Brep(<brep referenced from the Rhino model>)
box = DomainBox(Base=PlaneXY(0, 0, 0), X=Slider(20, range=0..30), Y=Slider(10, range=0..30), Z=Slider(15, range=0..30))
box_2 = Box(box)
debrep = DeconstructBrep(Brep=box_2)  # -> Faces, Edges, Vertices
brep = Brep(stairs)
top = ListItem(List=debrep.Faces, Index="5", Wrap=True)
bot = ListItem(List=debrep.Faces, Index="4", Wrap=True)
pop3d = Populate3D(Region=box_2, Count=Slider(13, range=1..20), Seed=Slider(5, range=1..20))
Z = UnitZ(Factor=Slider(-0.01, range=-0.01..0))
Z_2 = UnitZ(Factor=Slider(-0.01, range=-0.01..0))
voronoi³ = Voronoi3D(Points=pop3d, Box=box_2)  # -> Cells, Boundary
box_3 = Box(brep)
division = Division(A=Z, B=-2)
extr = Extrude(Base=top, Direction=Z)
division_2 = Division(A=Z_2, B=-2)
extr_2 = Extrude(Base=bot, Direction=Z_2)
pop3d_2 = Populate3D(Region=box_3, Count=Slider(10, range=0..1000), Seed=Slider(49, range=0..100))
debrep_2 = DeconstructBrep(Brep=voronoi³.Cells)  # -> Faces, Edges, Vertices
rdlines = RemoveDuplicateLinesKaramba3D(Line=flatten(debrep_2.Edges), LimitDistance=0.005)  # -> OutLine, Info, Indexes
cullpt = CullDuplicates(Points=flatten(debrep_2.Vertices), Tolerance=".001", CullMode=3)  # -> flatten(Points), Indices, Valence
move = Move(Geometry=extr, Motion=division)  # -> Geometry, Transform
move_2 = Move(Geometry=extr_2, Motion=division_2)  # -> Geometry, Transform
pop3d_3 = Populate3D(Region=brep, Count=Slider(5, range=1..100), Seed=Slider(54, range=1..100))
voronoi³_2 = Voronoi3D(Points=pop3d_2, Box=box_3)  # -> Cells, Boundary
brepsinc = PointInBreps(Brep=move.Geometry, Point=cullpt.Points, Strict=False)  # -> Inside, Index
brepsinc_2 = PointInBreps(Brep=move_2.Geometry, Point=cullpt.Points, Strict=False)  # -> Inside, Index
brepinc = PointInBrep(Brep=brep, Point=pop3d_3, Strict=False)
sint = SolidIntersection(BrepsA=voronoi³_2.Cells, BrepsB=brep)
dispatch = Dispatch(List=cullpt.Points, DispatchPattern=brepsinc.Inside)  # -> ListA, ListB
dispatch_2 = Dispatch(List=cullpt.Points, DispatchPattern=brepsinc_2.Inside)  # -> ListA, ListB
dispatch_3 = Dispatch(List=pop3d_3, DispatchPattern=brepinc)  # -> ListA, ListB
edges = BrepEdges(Brep=brep)  # -> Naked, Interior, NonManifold
edges_2 = BrepEdges(Brep=sint)  # -> Naked, Interior, NonManifold
midpt = CurveMiddle(Curve=edges.Interior)

# ---- group: Test Inputs
frame = Box(box_2)
load_pts = Point(dispatch.ListA)
supports = Point(dispatch_2.ListA)
lines = Curve(rdlines.OutLine)

# ----
crv = Curve(flatten(edges_2.Interior))
pt = Point(flatten([dispatch_3.ListA, midpt]))

# ---- group: just cut brep out of voronoi box
dupln = RemoveDuplicateLines(Lines=crv, Tolerance=0.01)

# ----
voronoi³_3 = Voronoi3D(Points=pt, Box=box_3)  # -> Cells, Boundary
con = DelaunayEdges(Points=pt, Plane=PlaneXY(0, 0, 0))  # -> Connectivity, Edges
del = DelaunayMesh(Points=pt, Plane=PlaneXY(0, 0, 0))
sint_2 = SolidIntersection(BrepsA=voronoi³_3.Cells, BrepsB=brep)
edges_3 = BrepEdges(Brep=sint_2)  # -> Naked, Interior, NonManifold
crv_2 = Curve(flatten(edges_3.Interior))

# ---- group: sort of based on brep edges
rdlines_2 = RemoveDuplicateLinesKaramba3D(Line=dupln, LimitDistance=0.005)  # -> OutLine, Info, Indexes
dupln_2 = RemoveDuplicateLines(Lines=crv_2, Tolerance=0.01)

# ----
Z_3 = UnitZ(Factor=Slider(-0.01, range=-0.01..0))
Z_4 = UnitZ(Factor=Slider(-0.01, range=-0.01..0))
srf = Surface(load_surfaces)
srf_2 = Surface(support_surfaces)
end = EndPoints(Curve=rdlines_2.OutLine)  # -> Start, End
division_3 = Division(A=Z_3, B=-2)
extr_3 = Extrude(Base=srf, Direction=Z_3)
division_4 = Division(A=Z_4, B=-2)
extr_4 = Extrude(Base=srf_2, Direction=Z_4)
cullpt_2 = CullDuplicates(Points=flatten([end.Start, end.End]), Tolerance=".001", CullMode=3)  # -> Points, Indices, Valence
move_3 = Move(Geometry=extr_3, Motion=division_3)  # -> Geometry, Transform
move_4 = Move(Geometry=extr_4, Motion=division_4)  # -> Geometry, Transform
brepsinc_3 = PointInBreps(Brep=move_3.Geometry, Point=cullpt_2.Points, Strict=False)  # -> Inside, Index
brepsinc_4 = PointInBreps(Brep=move_4.Geometry, Point=cullpt_2.Points, Strict=False)  # -> Inside, Index
dispatch_4 = Dispatch(List=cullpt_2.Points, DispatchPattern=brepsinc_3.Inside)  # -> ListA, ListB
dispatch_5 = Dispatch(List=cullpt_2.Points, DispatchPattern=brepsinc_4.Inside)  # -> ListA, ListB
supports_2 = Point(flatten(dispatch_5.ListA))
load_pts_2 = Point(flatten(dispatch_4.ListA))

# ---- group: Stairs Model
entwine = Entwine(Branch0X=load_pts_2, Branch1X=supports_2, Branch2X=rdlines_2.OutLine, Branch3X=box_3, FlattenInputs=False)

# ---- group: Test Model
entwine_2 = Entwine(Branch0X=load_pts, Branch1X=supports, Branch2X=lines, Branch3X=frame, FlattenInputs=False)

# ----
number_slider = Slider(5, range=1..5)
brep_2 = Brep(brep)
box_4 = Box(box_3)
voxcreate = CreateVoxelGrid(BoundingBox=box_4, SizeX=number_slider, SizeY=number_slider, SizeZ=number_slider)
voxgeo = VoxelateGeometry(Geometry=brep_2, VoxelGrid=voxcreate, Distance=0)
voxbox = VoxelGridToBoxes(VoxelGrid=voxgeo, Selection=1)  # -> Boxes, Points
edges_4 = BrepEdges(Brep=voxbox.Boxes)  # -> Naked, Interior, NonManifold
crv_3 = Curve(flatten(edges_4.Interior))
dupln_3 = RemoveDuplicateLines(Lines=crv_3, Tolerance=0.1)
end_2 = EndPoints(Curve=dupln_3)  # -> Start, End
bbox = BoundingBox(Content=flatten(dupln_3), Plane=PlaneXY(0, 0, 0), UnionBox=True)  # -> Box, Box_2
panel = Panel("""0
1
2
3""")
debrep_3 = DeconstructBrep(Brep=bbox.Box)  # -> Faces, Edges, Vertices
item = ListItem(List=debrep_3.Vertices, Index=panel, Wrap=True)
pt_2 = Point(flatten([end_2.Start, end_2.End, item]))
cullpt_3 = CullDuplicates(Points=pt_2, Tolerance=0.1, CullMode=3)  # -> Points, Indices, Valence
brep_3 = Brep([<brep referenced from the Rhino model> x3])
pdecon = Deconstruct(Point=cullpt_3.Points)  # -> XComponent, YComponent, ZComponent
brepsinc_5 = PointInBreps(Brep=brep_3, Point=cullpt_3.Points, Strict=False)  # -> Inside, Index
c_script = CSharpScript(X=pdecon.XComponent, Y=pdecon.YComponent, Z=pdecon.ZComponent)  # -> A; inputs X: list of Double, Y: list of Double, Z: list of Double
# ---------- c_script: C# ----------
    A = X.Count;
    //for (int i = 0; i < X.Count; i++)
# ---------- end c_script ----------
dispatch_6 = Dispatch(List=cullpt_3.Points, DispatchPattern=brepsinc_5.Inside)  # -> ListA, ListB

# ----
# AGENT BEHAVIOR
# Agent Vision Radius Factor
# Agent Effect Radius Factor
# Agent Strength
# Osteoblast Count
# Osteoclast Count
# Agent Population Seed
# AMOUNT OF ITERATIONS TO CALCULATE
iterations = Slider(0, range=0..20000)
vision_radius = Slider(2, range=0..2)
effect_radius = Slider(1, range=0..2)
strength = Slider(0.9, range=0..1)
osteoblast = Slider(10, range=0..100)
osteoclast = Slider(10, range=0..100)
seed = Slider(0, range=0..1000)
agent_input = GhPythonScript(vr=vision_radius, er=effect_radius, st=strength, ob=osteoblast, oc=osteoclast, se=seed)  # -> a; inputs ob: Int32, oc: Int32
# ---------- agent_input: Python ----------
a = [vr, er, st, ob, oc, se]
# ---------- end agent_input ----------

pt_3 = Point(dispatch_6.ListA)

# ---- group: Grid Infill Stairs
entwine_3 = Entwine(Branch0X=pt_3, Branch1X=item, Branch2X=dupln_3, Branch3X=bbox.Box, FlattenInputs=False)

# ---- group: Inputs
bang = ExplodeTree(Data=entwine_3)  # -> flatten(Branch0), flatten(Branch1), flatten(Branch2), flatten(Branch3)

# ----
# INSTANTIATE NEW MODEL
# GENERAL INPUTS
# Every Line of the Geometry
# Framework gets divided into n parts
# OPTIONAL GEOMETRY INPUT
# ALTERNATIVE EXAMPLE BOX
# Dimensions
# Infill-Pattern
X = Slider(20, range=1..20)
Y = Slider(10, range=1..20)
Z_5 = Slider(10, range=1..20)
list = ValueList({"Voronoi": 1, "Grid (work in progress)": 2}, selected="Voronoi")
density = Slider(5, range=1..10)
seed_2 = Slider(2, range=0..100)
# INPUT VARIABLES
beam_divisions = Slider(4, range=0..20)
agent_population_box = Box(bang.Branch3)
fixed_support_points = Point(bang.Branch1)
model_framework = Line(bang.Branch2)
fixed_load_points = Point(bang.Branch0)
# DISABLE SOLVER BEFORE EDITING
geometry = GhPythonScript(Line_Framework=model_framework, Support_Points=fixed_support_points, Load_Points=fixed_load_points)  # -> Status, geometry; inputs Line_Framework: list of Line, Support_Points: list of Point3d, Load_Points: list of Point3d
# ---------- geometry: Python ----------
#Check for Input
check = 0
Status = []

# Line Framework
if Line_Framework:
    Status.append("Line Framework loaded.")
    check += 1
else:
    Status.append("Line Framework unavailable.")

# Support Points
if Support_Points:
    Status.append("Support Points loaded.")
    check += 1
else:
    Status.append("Support Points unavailable.")

# Load Points
if Load_Points:
    Status.append("Load Points loaded.")
    check += 1
else:
    Status.append("Load Points unavailable.")

print(check)
if check == 3:
    geometry = [Line_Framework, Support_Points, Load_Points]
    Status = "Input geometry loaded."
# ---------- end geometry ----------
example_box = GhPythonScript(x=X, y=Y, z=Z_5, Infill_Pattern=list, Density=density, Seed=seed_2)  # -> box; inputs Infill_Pattern: Int32
# ---------- example_box: Python ----------
import Rhino.Geometry as rg
import ghpythonlib.components as ghc

xy_plane = rg.Plane(rg.Point3d(0,0,0),rg.Point3d(1,0,0),rg.Point3d(0,1,0))

frame = rg.Box(xy_plane, [rg.Point3d(0,0,0), rg.Point3d(x, y, z)])
voronoi_pts = ghc.Populate3D(frame, Density, Seed)
cells = ghc.Voronoi3D(voronoi_pts, frame)[0]
tmp = ghc.DeconstructBrep(cells)
lines = ghc.karambaGH.RemoveDuplicateLinesKaramba3D(tmp.edges)[0]
nodes_tmp = rg.Point3d.CullDuplicates(tmp.vertices, 0.001)

x_list = [point.X for point in nodes_tmp]
y_list = [point.Y for point in nodes_tmp]
z_list = [point.Z for point in nodes_tmp]

loads = []
supports = []
tol = 1e-7

for point in nodes_tmp:
    if abs(point.Z - max(z_list)) < tol:
        loads.append(point)
    if abs(point.Z - min(z_list)) < tol:
        if abs(point.X - min(x_list)) < tol or abs(point.X - max(x_list)) < tol:
            if abs(point.Y - min(y_list)) < tol or abs(point.Y - max(y_list)) < tol:
                supports.append(point)

box = [lines, supports, loads, x, y, z]
# ---------- end example_box ----------
panel_2 = Panel(geometry.Status)

beam_divisions_2 = Integer(beam_divisions)
number_slider_2 = Slider(0.6, range=0..1)

# ----
# State
# LOAD EXISTING MODEL
# Mode
# Path (format: "C:\Folder\Folder\Folder\")
# Model status
# File name
# ## = "Show save state"-value is higher than
#           the amount of saved steps in the model
#                -> displaying the latest possible state
# ANALYSE MODEL
# Disables all agent behavior and calculations
# to load raw geometry and values from the file
# Show save state
# CONTINUE PROCESSING
# Continue from latest possible save state
# OR Continue from save state
panel_3 = Panel("C:\University\3. Semester\Artificial Ossification\pkl\")
n = Slider(41, range=1..100)
n_2 = Slider(1, range=1..100)
list_2 = ValueList({"Continue Processing": 0, "Analyse Model": 1}, selected="Analyse Model")
on_off = BooleanToggle(False)

# ----
# State
# Deactivate Solver,
# toggle Save ON,
# activate Solver,
# deactivate Solver,
# toggle Save OFF
# SAVE CURRENT MODEL
# File status
# Save states:
#  File size:
# Path (format: "C:\Folder\Folder\Folder\")
# File name
# Save every n iteration
panel_4 = Panel("C:\University\3. Semester\Artificial Ossification\pkl\")
n_3 = Slider(4, range=1..100)
on_off_2 = BooleanToggle(False)

# ---- group: main_component
ghpython_script = GhPythonScript(
    beam_divisions=beam_divisions_2,
    population_frame=agent_population_box,
    geometry=geometry.geometry,
    box=example_box,
    Load=on_off,
    Load_mode=list_2,
    l_path=panel_3,
    l_file_name="test_file_name",
    show_save=n,
    latest_save=Toggle(True),
    continue_from=n_2,
    Save=on_off_2,
    s_path=panel_4,
    s_file_name="test_file_name_2",
    save_every_n=n_3,
    agent_input=agent_input,
    iterations=iterations)  # -> radii_out, probe_points_out, tensions_out, osteoblast_paths_out, osteoclast_paths_out, osteoblast_targets_out, osteoclast_targets_out, ka_model_out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; inputs beam_divisions: Int32, population_frame: Box, geometry: list, box: list, Load: Boolean, Load_mode: Boolean, show_save: Int32, latest_save: Boolean, Save: Boolean, agent_input: list, iterations: Int32
# ---------- ghpython_script: Python ----------
import copy
import System
import rhinoscriptsyntax as rs
import Rhino.Geometry as rg
import ghpythonlib.components as ghc
import clr
clr.AddReferenceToFileAndPath("C:\Program Files\Rhino 6\Plug-ins\Karamba\Karamba.gha")
clr.AddReferenceToFileAndPath("C:\Program Files\Rhino 6\Plug-ins\Karamba\KarambaCommon.dll")
import Karamba as ka
import Karamba.GHopper as kagh
import ghpythonlib.treehelpers as th
import KarambaCommon as kac
import ghpythonlib.treehelpers as th
import math
import cPickle as pickle
import gzip
import os

xy_plane = rg.Plane(rg.Point3d(0,0,0),rg.Point3d(1,0,0),rg.Point3d(0,1,0))
xz_plane = rg.Plane(rg.Point3d(0,0,0),rg.Point3d(1,0,0),rg.Point3d(0,0,1))

# since ironpython doesn't have math.isclose() i need to set my own tolerance for comparisons 
tol = 1e-7

# faktor für die achsenverschiebung von 0 bis 1
shift_factor = 0.2
cluster_limit = 1

# only instantiate model class, when there is no model to be loaded
class xmodel:
    '''object that stores and manages the properties of the geometry to optimize, including the karamba model'''
    
    def __init__(self, lines = None, supports = None, load_pts = None):
        self.probes = []
        self.lines = lines
        self.supports = supports
        self.load_pts = load_pts
        self.frame = population_frame
        self.ka_supports = None
        self.ka_loads = None
        self.ka_elements = None
        self.ka_model = None
        
    def set_geometry(self, geo):
        self.lines = geo[0]
        self.supports = geo[1]
        self.load_pts = geo[2]
    
    def initialize_probes(self):
        # divides fillament into probe points
        points_tmp = []
        for line in self.lines:
            # convert lines to rhino.geometry
            line = rg.LineCurve(line)
            t_temp = line.DivideByCount(beam_divisions-1, True) 
            for t in t_temp:
                points_tmp.append(line.PointAt(t))
        
        for i in range(len(points_tmp)):
            self.probes.append(xprobe_point(points_tmp[i], i, initial_filament_radius))
        
        for j in range(len(self.probes)):
            self.probes[j].determine_node()
            #count_node returns True to increase node counter number for the next node 
            if self.probes[j].count_node() == True:
                global node_counter
                node_counter += 1
            
            self.probes[j].check_if_support()
            self.probes[j].check_if_load_pt()
        
    def update_probe_tensions(self):
        for i in range(len(self.probes)):
            self.probes[i].calc_tension()
        for j in range(len(self.probes)):
            if self.probes[j].node == True:
                self.probes[j].equalize_node() # necessary here?
                #self.probes[i].equalize_node_radii() # necessary here?
        
    def update_probe_positions(self):
        points_tmp = []
        for line in self.lines:
            # convert lines to rhino.geometry
            line = rg.LineCurve(line)
            t_temp = line.DivideByCount(beam_divisions-1, True) 
            for t in t_temp:
                points_tmp.append(line.PointAt(t))
        
        for i in range(len(points_tmp)):
            self.probes[i].point = points_tmp[i]
    
    def update_model_axis(self):
        node_list = []
        new_lines = []
        
        for i in range(node_counter):
            tmp_pts_indices = []
            tmp_pts = None
            for j in range(len(self.probes)):
                if self.probes[j].node == True:
                    # maybe exclude loads and supports here
                    if self.probes[j].node_number == i:
                        tmp_pts_indices.append(j)
            for k in tmp_pts_indices:
                if self.probes[k].point_shifted == None:
                    self.probes[k].point_shifted = self.probes[k].point
                if tmp_pts == None:
                    tmp_pts = self.probes[k].point_shifted
                tmp_pts += self.probes[k].point_shifted
            new_node = tmp_pts/(len(tmp_pts_indices)+1)

            for m in tmp_pts_indices:
                self.probes[m].point = copy.deepcopy(new_node)
                
        for n in range(len(self.probes)):
                if self.probes[n].node == True:
                    node_list.append(n)
        for o in range(len(node_list)):
            if o % 2 == 0:
                new_lines.append(rg.Line(self.probes[node_list[o]].point, self.probes[node_list[o+1]].point))
        self.lines = new_lines
        self.update_probe_positions()
        self.update_probe_tensions()
                
    def reset_cluster_counter(self):
        for i in range(len(model.probes)):
            model.probes[i].targeted = 0
    # there are Karamba.Geometry and Karamba.GHopper.Geometry types for C# and GH envoirenment.  
    # most of the karamba geometry is done with ghpythonlib.components, which just mirrors the grasshopper-component, but still results in Karamba.Geometry.
    # after each function the Karamba.Geometry is converted to Karamba.GHopper.Geometry as required for the ghpythonlib model-assembly.
    # only the model and beam calculation is done within the Karamba.Geometry Namespace
    
    def get_ka_supports(self):
        # getting the points converted to karamba-supports and then to karambaGH-supports
        support_conditions = System.Collections.Generic.List[bool]()
        for i in range(6):
            support_conditions.Add(True)
        supports_tmp = []

        for i in range(node_counter):
            for j in range(len(self.probes)):
                if self.probes[j].support_pt == True and self.probes[j].node_number == i:
                    point_tmp = kagh.Geometry.GeometryExtensions.Convert(self.probes[j].point)
                    plane_tmp = copy.deepcopy(xy_plane)
                    plane_tmp = kagh.Geometry.GeometryExtensions.Convert(plane_tmp)
                    supports_tmp.append(ka.Supports.Support(point_tmp , support_conditions, plane_tmp ))
                    break
        self.ka_supports = [kagh.Supports.GH_Support(x) for x in supports_tmp]
        
    def get_ka_loads(self):
        loads_tmp = []
        #rotation
        #point_tmp = rg.Point3d(0,0,-100)
        #rotation = (100-iterations)*math.pi/180/8
        #point_tmp2 = ghc.Rotate(point_tmp, rotation, xz_plane)[0]
        # annoying conversion from gh to karamba
        f = kagh.Geometry.GeometryExtensions.Convert(rg.Vector3d(0,0,-100))  # originally rg.Vector3d(0,0,-100) for 100 kN
        m = kagh.Geometry.GeometryExtensions.Convert(rg.Vector3d(0,0,0))
        for i in range(node_counter):
            for j in range(len(self.probes)):
                if self.probes[j].load_pt == True and self.probes[j].node_number == i:
                    # more annoying conversion from gh to karamba
                    ka_point = copy.deepcopy(self.probes[j].point)
                    ka_point = kagh.Geometry.GeometryExtensions.Convert(ka_point)
                    loads_tmp.append(ka.Loads.PointLoad(ka_point, f, m, 0, False))
                    break
        # converting karamba-loads to karambaGH-loads
        self.ka_loads = [kagh.Loads.GH_Load(x) for x in loads_tmp]
        
    def get_ka_elements(self):
        # getting the lines converted to karamba-elements and then to karambaGH-elements
        elements_tmp = ghc.karambaGH.LinetoBeamKaramba3D(self.lines)[0]
        if len(elements_tmp) != len(self.lines):
            print('beam intersection detected') 
        self.ka_elements = [kagh.Elements.GH_Element(x) for x in elements_tmp]
        
    def calc_ka_model(self):
        
        self.get_ka_supports()
        self.get_ka_loads()
        self.get_ka_elements()
        model_tmp = ghc.karambaGH.AssembleModelKaramba3D(elem = self.ka_elements, support = self.ka_supports,  load = self.ka_loads)[0]
        self.ka_model = ka.Algorithms.ThIAnalyze.solve(model_tmp)[4]
        
    def calc_beam_forces(self):
        # returns forces in a list of lists where [0]normal force [1]Mt [2]My [3]Mz for every point
        tmp_list = []
        # creating a list for every point
        for i in range(len(self.probes)):
            tmp_list.append([])
        element_ids = System.Collections.Generic.List[str]()
        for element in self.ka_model.elems:
            element_ids.Add(element.id)
        #loop through elements of model
        tmp_lines_length = [line.Length for line in self.lines]
        model_forces = ka.Results.BeamForces.solve(self.ka_model, element_ids, -1, max(tmp_lines_length), beam_divisions)[0]
        # this whole part is a relic from an earlier version and could be done clearer
        for i in range(len(model_forces)):
            #loop through points on elements
            for j in range(len(model_forces[i])):
                normal_force = model_forces[i][j][0]
                tmp_list[(i*len(model_forces[i])+j)].append(abs(normal_force)) #inverting all negative normal forces(tensile stres) might distort results
                tmp_list[(i*len(model_forces[i])+j)].append(model_forces[i][j][3])
                tmp_list[(i*len(model_forces[i])+j)].append(model_forces[i][j][4])
                tmp_list[(i*len(model_forces[i])+j)].append(model_forces[i][j][5])
        for i in range(len(tmp_list)):
            self.probes[i].forces = tmp_list[i]

class xprobe_point:
    '''object that encapsulates several properties of a fillament probe point'''
    def __init__(self, point, index, radius):
        self.plane = None
        self.point = point
        self.locked = False
        self.support_pt = False
        self.load_pt = False
        self.point_shifted = None
        self.index = index
        self.line_index = int(math.floor(self.index/beam_divisions)) # unsolved problem with indice 0
        self.forces = None
        self.radius = radius
        self.tension = None 
        self.tension_line = None
        self.node = False
        self.node_number = None
        self.targeted = 0
        
    def determine_node (self):
        # check if probe_point is a node
        for i in range(len(model.probes)):
            if self.index != model.probes[i].index and self.point == model.probes[i].point:
                self.node = True
    
    def check_if_support(self):
        
        if self.point in model.supports:
            self.support_pt = True
            self.locked = True
    
    def check_if_load_pt(self):
        
        if self.point in model.load_pts:
            self.load_pt = True
            self.locked = True
    
    def count_node (self):
        #checks for new unseen nodes, assigns current node_count number to all points of the node and returns True to increase node_counter
        for i in range(len(model.probes)):
            if model.probes[i].node_number == None and model.probes[i].node == True:
                node_group_indices = [j.index for j in model.probes if model.probes[i].point == j.point]
                for k in node_group_indices:
                    model.probes[k].node_number = node_counter
                return True
    
    def calc_tension(self):
        self.calc_tension_complete()
        self.calc_tension_lines()
    
    def calc_tension_normal_force(self):
        A = (math.pi * (self.radius ** 2))
        N = self.forces[0]
        self.tension = N/A  # tension is N/A at given probe point (A = pi*r²)
        
    def calc_tension_moment(self):
        M = math.sqrt(self.forces[2]**2+self.forces[3]**2)
        I = (math.pi*self.radius**4)/4
        self.tension = M/I
    
    def calc_tension_complete(self):
        A = (math.pi * (self.radius**2)) # A[cm²] = pi*r²[cm]
        N = self.forces[0] # [kN]
        M = math.sqrt(self.forces[2]**2+self.forces[3]**2)*100 # umrechnung von [kNm] in [kNcm]
        W = (math.pi*((self.radius*2)**3))/32
        self.tension = abs(N/A) + M/W # abs hier richtig?

    
    def get_local_ka_plane(self):
        element = model.ka_elements[int(math.floor(self.index/beam_divisions))]
        # I'm mapping the local coordinate system for each probe point according to a relation i found between karambas "disassemble elemement local coordinate system" and karambas beam forces Mx and My moments
        tmp_plane = ghc.karambaGH.DisassembleElementKaramba3D(element)[6]
        self.plane = rg.Plane(self.point, tmp_plane.ZAxis, rg.Vector3d.Negate(tmp_plane.YAxis))
    
    def calc_tension_lines(self):
        self.get_local_ka_plane()
        point = rg.Point3d(self.forces[2]/30, self.forces[3]/30, 0) # find better solution to scale tension lines/shift factor
        xform = rg.Transform.PlaneToPlane(xy_plane, self.plane)
        point.Transform(xform)
        self.tension_line = rg.Line(self.point ,point)
        
    # assign highest tension to all probe points at a node to prevent agents to get in a tug war over one node with diffrent inherit tesions
    def equalize_node(self):
        
        node_group_indices = [i.index for i in model.probes if self.node_number == i.node_number]
        node_group_tensions = [model.probes[j].tension for j in node_group_indices]
        node_group_radii = [model.probes[j].radius for j in node_group_indices]
        
        for k in node_group_indices:
            model.probes[k].radius = max(node_group_radii)
            model.probes[k].tension = max(node_group_tensions)
            
    # radius transformations to a single point of a node are transfered to the other points
    def equalize_current_node(self): # unused
        self.calc_tension()
        node_group_indices = [i.index for i in model.probes if self.node_number == i.node_number]
        #print(node_group_indices)
        for j in node_group_indices:
            model.probes[j].radius = self.radius
            model.probes[j].calc_tension()
    
    def update_after_shift(self): # old ?
        self.plane = new_plane
        self.point = self.plane.Origin
        self.calc_tension()
        self.equalize_node()



class xagent:
    '''base class for osteoblast and osteoclast''' 
    def __init__(self, point):
        self.point = point
        self.path_record = []
        
    def get_target(self):
        #check for the point with the highest/lowest tension within vision range
        tension_extreme = None
        target_index = None
        vision_tmp = agent_vision_radius
        
        while target_index == None:
            for i in range(len(model.probes)):
                if model.probes[i].targeted < cluster_limit:
                    if self.point.DistanceTo(model.probes[i].point) <= vision_tmp:
                        if self.osteoblast:
                            #osteoblast finding probe point with max tension
                            if tension_extreme == None or tension_extreme < model.probes[i].tension:
                                tension_extreme = model.probes[i].tension
                                target_index = i
                        if self.osteoclast:
                            #prevent osteoclast from freezing by targeting andtrying to decrease a probe point radius below minimum threshold 
                            if model.probes[i].radius > filament_radius_threshold*1.1:
                                #osteoclast finding probe point with min tension
                                if tension_extreme == None or tension_extreme > model.probes[i].tension:
                                    tension_extreme = model.probes[i].tension
                                    target_index = i
            vision_tmp += max_element_length/5
            if vision_tmp >= max_element_length*5 :
                print('infinite loop last bail')
                break
        
        if model.probes[target_index].node == True:
            node_group_indices = [i.index for i in model.probes if model.probes[target_index].node_number == i.node_number]
            for j in node_group_indices:
                model.probes[j].targeted += 1
        else:
            model.probes[target_index].targeted += 1
        return model.probes[target_index].point
        
    def move(self, targetpoint):
        # move agent in the direction of input target according to speed
        temp_move_vec = None
        temp_move_vec_scaled = None
        
        #prevent overshooting the targetpoint
        if self.point.DistanceTo(targetpoint) <= agent_speed:
            self.point = targetpoint
            self.path_record.append(targetpoint)
        #getting movement vector and magnitude from origin to targetpoint
        else:
            temp_move_vec = targetpoint - self.point
            temp_move_vec_scaled = rg.Vector3d.Multiply(temp_move_vec, (agent_speed/temp_move_vec.Length))
            self.point = self.point + temp_move_vec_scaled
            self.path_record.append(self.point)
            
    def get_closest_probe_index(self, originpoint = None):
        if originpoint == None:
            originpoint = self.point
        closest_point_index = None
        for i in range(len(model.probes)):
            if closest_point_index == None or originpoint.DistanceTo(model.probes[i].point) < originpoint.DistanceTo(model.probes[closest_point_index].point):
                closest_point_index = i
        return closest_point_index
        
    def work_closest(self):
        closest = self.get_closest_probe_index()

        # osteoblast increase cross-section radius at nearby probe points
        if self.point.DistanceTo(model.probes[closest].point) <= agent_effect_radius:
            agent_factor = 0
            if self.osteoblast == True:
                agent_factor = 1
            if self.osteoclast == True and model.probes[closest].radius >= filament_radius_threshold:
                agent_factor = -1
            if model.probes[closest].node == True:
                node_group_indices = [i.index for i in model.probes if model.probes[closest].node_number == i.node_number]

                for j in node_group_indices:
                    # the agent factor makes the osteoblast add and the osteoclast remove radius
                    model.probes[j].radius += agent_strength * agent_factor 
                    model.probes[j].calc_tension()
                model.probes[closest].equalize_node()
            else:
                # update the tension for new cross-section
                model.probes[closest].radius += agent_strength * agent_factor
                model.probes[closest].calc_tension()


    def axis_shift(self):
        closest = self.get_closest_probe_index()
        line_index = model.probes[closest].line_index
        t = model.lines[line_index].ClosestParameter(model.probes[closest].point)
        if self.point.DistanceTo(model.probes[closest].point) <= agent_effect_radius:
            # check on which side of the fillament the agent is
            if t > 0.5:
                start = 0
                end = 1
            else:
                start = 1
                end = 0
            rotation_center = model.lines[line_index].PointAt(start)
            rotation_pt = model.lines[line_index].PointAt(end)
            # the probe point at the end of the current fillament is checked for support or load status, in which case it isn't moved
            rotation_probe_index = self.get_closest_probe_index(rotation_pt)
            if model.probes[rotation_probe_index].locked == False:
                rotation_vector1 = rotation_center - model.probes[closest].tension_line.PointAt(0)
                # the shift factor determines the degree of the rotation by moving the axis in the direction of the moment line 
                rotation_vector2 = rotation_center - model.probes[closest].tension_line.PointAt(shift_factor)
                # by rotation from the end to the start of the moment line we achieve a rotation in the opposite direction of the moment
                xform = rg.Transform.Rotation(rotation_vector2, rotation_vector1, rotation_center)
                # find the corresponding probe point at the end of the axis to rotate
                for i in range(len(model.probes)):
                    if line_index == model.probes[i].line_index and rotation_pt == model.probes[i].point:
                        if model.probes[i].point_shifted == None:
                            model.probes[i].point_shifted = copy.deepcopy(model.probes[i].point)
                        model.probes[i].point_shifted.Transform(xform)


    def work_multiple (self):
        for i in range(len(model.probes)):
            if self.point.DistanceTo(model.probes[i].point) <= agent_effect_radius:
                # osteoblast increase cross-section radius at nearby probe points
                if self.osteoblast: 
                    model.probes[i].radius += agent_strength
                 # osteoclast decrease cross-section radius at nearby probe points
                elif model.probes[i].radius >= filament_radius_threshold:
                    model.probes[i].radius -= agent_strength
                #update the tension for new cross-section
                model.probes[i].calculate_tension()



class xosteoblast(xagent):
    '''Agent that moves to areas of highest tension and increases cross-section'''
    osteoblast = True
    osteoclast = False



class xosteoclast(xagent):
    '''Agent that moves to areas of highest tension and increases cross-section'''
    osteoblast = False
    osteoclast = True



class Save_Load:
    
    def __init__(self):
        
        self.loaded_model = []
        self.saved_model = []
    
    
    def save_iteration(self):
        
        # convert geometry and values to a saveable format
        
        lines_txt = model.lines
        supports_txt = model.supports
        load_pts_txt = model.load_pts
        
        probes_txt = []
        
        for i in range(len(model.probes)):
            probe = [] # temporary singular probe array
            probe.append(model.probes[i].plane)
            probe.append(model.probes[i].point)
            probe.append(model.probes[i].locked)
            probe.append(model.probes[i].support_pt)
            probe.append(model.probes[i].load_pt)
            probe.append(model.probes[i].point_shifted)
            probe.append(model.probes[i].index)
            probe.append(model.probes[i].line_index)
            probe.append(model.probes[i].forces)
            probe.append(model.probes[i].radius)
            probe.append(model.probes[i].tension)
            probe.append(model.probes[i].tension_line)
            probe.append(model.probes[i].node)
            probe.append(model.probes[i].node_number)
            probe.append(model.probes[i].targeted)
            
            probes_txt.append(probe) # list of all probes
        
        osteoblasts_txt = []
        for i in range(len(osteoblasts)):
            obs = [] # temporary singular osteoblast array
            obs.append(osteoblasts[i].point)
            obs.append(osteoblasts[i].path_record)
            
            osteoblasts_txt.append(obs) # list of all osteoblasts
        
        osteoclasts_txt = []
        for i in range(len(osteoclasts)):
            ocs = [] # temporary singular osteoclast array
            ocs.append(osteoclasts[i].point)
            ocs.append(osteoclasts[i].path_record)
            
            osteoclasts_txt.append(ocs) # list of all osteoclasts
        
        
        
        # add current iteration to "saved_model"
        
        saved_iteration = []
        
        saved_iteration.append(lines_txt)
        saved_iteration.append(load_pts_txt)
        saved_iteration.append(supports_txt)
        saved_iteration.append(probes_txt)
        saved_iteration.append(osteoblasts_txt)
        saved_iteration.append(osteoclasts_txt)
        saved_iteration.append(node_counter)
        saved_iteration.append(iteration_counter)
        
        self.saved_model.append(saved_iteration)
    
    
    def save_model(self):
        
        if Save:
            #outfile = open(r"{}{}.pkl".format(path,file_name),'wb')
            outfile = gzip.GzipFile(r"{}{}.pkl".format(s_path,s_file_name), 'wb')
            pickle.dump(self.saved_model, outfile)
            outfile.close()
    
    
    def load_model(self):
        
        #infile = open(r"{}{}.pkl".format(path,file_name),'rb')
        infile = gzip.GzipFile(r"{}{}.pkl".format(l_path,l_file_name), 'rb')
        self.loaded_model = pickle.load(infile)
        infile.close()
    
    
    def load_iteration(self, n):
        
        lm = self.loaded_model[n]
        
        # model.lines = lm[0]
        # model.supports = lm[1]
        # model.load_pts = lm[2]
        model.set_geometry([lm[0], lm[1], lm[2]])
        
        model.probes = []
        
        #print(lm[3][0][10])
        
        for i in range(len(lm[3])):
            
            model.probes.append(xprobe_point(lm[3][i][1], lm[3][i][6], lm[3][i][9]))
            
            model.probes.append
            model.probes[i].plane = lm[3][i][0] # [3] for the .probe attribute array; [i] for the selected singular probe point; [0] for the .plane attribute
            model.probes[i].point = lm[3][i][1]             #
            model.probes[i].locked = lm[3][i][2]
            model.probes[i].support_pt = lm[3][i][3]
            model.probes[i].load_pt = lm[3][i][4]
            model.probes[i].point_shifted = lm[3][i][5]
            model.probes[i].index = lm[3][i][6]             #
            model.probes[i].line_index = lm[3][i][7]
            model.probes[i].forces = lm[3][i][8]
            model.probes[i].radius = lm[3][i][9]            #
            model.probes[i].tension = lm[3][i][10]
            model.probes[i].tension_line = lm[3][i][11]
            model.probes[i].node = lm[3][i][12]
            model.probes[i].node_number = lm[3][i][13]
            model.probes[i].targeted = lm[3][i][14]
        
        #print(model.probes[0].tension)
        
        for i in range(len(lm[4])):
            osteoblasts.append(xosteoblast(lm[4][i][0]))
            #osteoblasts[i].point = lm[4][i][0]
            osteoblasts[i].path_record = lm[4][i][1]
        
        for i in range(len(lm[5])):
            osteoclasts.append(xosteoclast(lm[5][i][0]))
            #osteoclasts[i].point = lm[5][i][0]
            osteoclasts[i].path_record = lm[5][i][1]
        
        global node_counter
        node_counter = lm[6]
        
        global iteration_counter
        iteration_counter = lm[7]


#############################################################################################################################

# INITIALIZE MODEL

model = xmodel()
if Save or Load:
    saveload = Save_Load()

osteoblasts = []
osteoclasts = []
node_counter = 0

agent_vision_radius_factor = agent_input[0]
agent_effect_radius_factor = agent_input[1]
agent_strength = agent_input[2]
osteoblast_number = agent_input[3]
osteoclast_number = agent_input[4]
seed = agent_input[5]


#############################################################################################################################

if Load:
    # LOAD EXISTING MODEL
    saveload.load_model()
    save_count = len(saveload.loaded_model)
    
    if Load_mode:
        # only analyse model
        if show_save > save_count:
            show_save = save_count
            save_count = str(save_count) + " ##"
        saveload.load_iteration(show_save - 1)
        calc = False
    else:
        # continue processing        
        if latest_save:
            # continue from latest save step
            saveload.load_iteration(len(saveload.loaded_model)-1)
        else:
            # continue from n
            saveload.load_iteration(continue_from-1)
        calc = True
else:
    # INSTANTIATE NEW MODEL
    if geometry[0]:
        # from Input
        model.set_geometry(geometry)
    else:
        # example box if no input given
        model.set_geometry(box[0:3])
        model.population_frame = rg.Box(rg.Plane(rg.Point3d(0,0,0),rg.Point3d(1,0,0),rg.Point3d(0,1,0)), [rg.Point3d(0,0,0), rg.Point3d(box[3], box[4], box[5])])
    iteration_counter = 0
    calc = True

elements_length = [i.Length for i in model.lines]
max_element_length = math.ceil(max(elements_length))

initial_filament_radius = max_element_length / 0.5
filament_radius_threshold = initial_filament_radius / 5  # danger: if the threshold is larger than the initial radius move() will produce an infinite loop
agent_vision_radius = max_element_length * agent_vision_radius_factor / 2 # <3
agent_effect_radius = agent_vision_radius * agent_effect_radius_factor / 3.5
agent_speed = max_element_length / 10

if not Load:
    model.initialize_probes()
    # initialize agent startpoints
    osteoclast_points = ghc.Populate3D(model.frame, osteoclast_number, seed)
    osteoblast_points = ghc.Populate3D(model.frame, osteoblast_number, seed+1)
    
    if type(osteoblast_points) is rg.Point3d:
        # ensure to get a list for a single agent to prevent type errors
        osteoblast_points = [osteoblast_points]  
    for i in range(osteoblast_number):
        osteoblasts.append(xosteoblast(osteoblast_points[i]))
    
    # initialize osteoclast instances
    
    if type(osteoclast_points) is rg.Point3d:
        # ensure to get a list for a single agent to prevent type errors
        osteoclast_points = [osteoclast_points] 
    for i in range(osteoclast_number):
        osteoclasts.append(xosteoclast(osteoclast_points[i]))

if calc:
    # CALCULATE MODEL
    model.calc_ka_model()
    model.calc_beam_forces()
    model.update_probe_tensions()
    
    if Save and Load:
        # set loaded_model list as origin for save_model list
        saveload.saved_model = saveload.loaded_model
    
    # cycle through iterations
    for i in range(iterations):
        for j in range(osteoblast_number):
            osteoblasts[j].move(osteoblasts[j].get_target())
            osteoblasts[j].work_closest()
            osteoblasts[j].axis_shift()
        for k in range(osteoclast_number):
            osteoclasts[k].move(osteoclasts[k].get_target())
            osteoclasts[k].work_closest()
            osteoclasts[k].axis_shift()
        model.reset_cluster_counter()
        model.update_model_axis()
        model.calc_ka_model()
        model.calc_beam_forces()
        
        iteration_counter += 1
        
        # save every n iteration
        if Save and (i+1) % save_every_n == 0:
            print("saved at iteration " + str(iteration_counter))
            saveload.save_iteration()
    
    if Save:
        # SAVE CURRENT MODEL
        saveload.save_model()

#############################################################################################################################

# OUTPUTS

radii_out = []
probe_points_out = []
tensions_out = []
tension_lines_out = []

for i in range(len(model.probes)):
    radii_out.append(model.probes[i].radius)
    probe_points_out.append(model.probes[i].point)
    tensions_out.append(model.probes[i].tension)
    tension_lines_out.append(model.probes[i].tension_line)

probe_points_out = th.list_to_tree(probe_points_out)

#export osteoblasts
osteoblast_targets_out = []
osteoblast_paths_out = []

for i in range(osteoblast_number):
    osteoblast_paths_out.append(osteoblasts[i].path_record)
    osteoblast_targets_out.append(osteoblasts[i].get_target())
osteoblast_paths_out = th.list_to_tree(osteoblast_paths_out)
osteoblast_targets_out =th.list_to_tree(osteoblast_targets_out)


#export osteoclasts
osteoclast_targets_out = []
osteoclast_paths_out = []
for i in range(osteoclast_number):
    osteoclast_paths_out.append(osteoclasts[i].path_record)
    osteoclast_targets_out.append(osteoclasts[i].get_target())
osteoclast_paths_out = th.list_to_tree(osteoclast_paths_out)
osteoclast_targets_out =th.list_to_tree(osteoclast_targets_out)

if calc:
    ka_model_out = ka.GHopper.Models.GH_Model(model.ka_model)
    ka_supports_out = model.ka_supports
    ka_elements_out = model.ka_elements
    load_pts_out = model.load_pts

if Load:
    load_data = " Save states available:  {}\n Loaded iteration:       {}".format(str(save_count), str(iteration_counter))
else:
    load_data = " Save states available:     off\n Loaded iteration:          off"

if Save:
    save_data = " Save states:  {}".format(str(len(saveload.saved_model)))
else:
    save_data = " Save states: off"
# ---------- end ghpython_script ----------

# ----
# OR
panel_5 = Panel(ghpython_script.load_data)

panel_6 = Panel(ghpython_script.save_data)

# ----
# karamba cross-section optimization
number_slider_3 = Slider(150, range=0..200)
negative = Negative(Value=number_slider_3)
unit_z = UnitZ(Factor=negative)
cross_section_range_selector_karamba3d = CrossSectionRangeSelectorKaramba3D(MaximumHeight_cm=-1, MaximumWidth_cm=-1, menu=[dropdown(1), dropdown(2), dropdown(1)])
loads_karamba3d = LoadsKaramba3D(ForceVector=unit_z, Local=False, PosInd=ghpython_script.load_pts_out, LCase=0, mode="Point")
assemble_model_karamba3d = AssembleModelKaramba3D(
    Elem=ghpython_script.ka_elements_out,
    Support=ghpython_script.ka_supports_out,
    Load=loads_karamba3d,
    CrossSection=cross_section_range_selector_karamba3d,
    LimitDistance_m=0.005)  # -> Model, Info, Mass_kg, CenterOfGravity
optimize_cross_section_karamba3d = OptimizeCrossSectionKaramba3D(
    Model=assemble_model_karamba3d.Model,
    CrossSections=cross_section_range_selector_karamba3d,
    MaximumUtilization=1,
    MaximumDisplacement_cm=-1,
    UltimateLimitStateIterations=5,
    DisplacementIterations=5,
    NumberOfSamplePoints=3,
    ElasticDesign=True,
    GammaM0=1,
    GammaM1=1)  # -> ModelWithOptimizedCrossSections, Info, Mass_kg, MaximumDisplacement_cm, ElasticEnergy_kNm
analyze_karamba3d = AnalyzeKaramba3D(Model=assemble_model_karamba3d.Model)  # -> CalculatedModel, MaximumDisplacement_cm, ResultingForceOfGravity_kN, ElasticEnergy_kNm
beam_view_karamba3d = BeamViewKaramba3D(Model=optimize_cross_section_karamba3d.ModelWithOptimizedCrossSections)  # -> Model, MeshesOfRenderedBeams, DeformedBeamAxes, LegendColors, LegendTags

text_baker = TextBaker(
    Location=ghpython_script.probe_points_out,
    Text=ghpython_script.tensions_out,
    Size=Slider(0.1, range=0..0.1),
    Justification=6,
    Bake=False)

data = Data(ghpython_script.ka_model_out)
model_view_karamba3d = ModelViewKaramba3D(Model=data, ResultFactors=1, ResultCase=-1)  # -> Model, DeformedMesh, DeformedAxes, DeformedModel
beam_view_karamba3d_2 = BeamViewKaramba3D(Model=model_view_karamba3d.Model)  # -> Model, MeshesOfRenderedBeams, DeformedBeamAxes, LegendColors, LegendTags
curve = Curve(beam_view_karamba3d_2.DeformedBeamAxes)
dispatch_7 = Dispatch(List=curve, DispatchPattern=[True, False])  # -> ListA, ListB; disabled

# ---- group: stress distribution
# min | max
# average
bar_graph = BarGraph(ghpython_script.tensions_out, BarColor=RGB(255, 0, 90))
quick_graph = QuickGraph(ghpython_script.tensions_out, SortOrder=0)
bounds = Bounds(Numbers=ghpython_script.tensions_out)
mass_addition = MassAddition(Input=ghpython_script.tensions_out)  # -> Result, PartialResults
panel_7 = Panel(bounds)
list_length = ListLength(List=ghpython_script.tensions_out)
division_5 = Division(A=mass_addition.Result, B=list_length)
panel_8 = Panel(division_5)

# ---- group: moment distribution
length = Length(Curve=ghpython_script.tension_lines_out)
bar_graph_2 = BarGraph(length, BarColor=RGB(255, 0, 90))
bounds_2 = Bounds(Numbers=length)
quick_graph_2 = QuickGraph(length, SortOrder=0)
panel_9 = Panel(bounds_2)
mass_addition_2 = MassAddition(Input=length)  # -> Result, PartialResults
list_length_2 = ListLength(List=length)
division_6 = Division(A=mass_addition_2.Result, B=list_length_2)
# known errors/missing:
# 
# EQUAL LOAD DISTRIBUTION
# uneven distribution of probe points(depending on lenght)
# wrong index number first line
# simultanious update?
# material application trough area not radius
# killing groups(?)
# geometry input
# equalibrium calculation <- galapagos optimization
# achsverschiebung
# agent targetpoint considering distance(?)
# joints with multipipe
# agent balance research
# constant material (?)
# no target in range error
# vision, speed, area_of_ effect and scale koppeln
# animation with changing loads
# initialize agents on probe_points
# recalculate ka_model with ever shorter intervals
# train neural net by inputting only the graph and the forces
# temporarily increase vision if out of range
# shift permanently active
# no target error
panel_10 = Panel(division_6)

# ----
item_2 = ListItem(List=ghpython_script.probe_points_out, Index=Slider(429, range=0..1000), Wrap=True)
panel_11 = Panel(item_2)

# ---- group: moment lines
curve_2 = Curve(ghpython_script.tension_lines_out)
custom_preview_lineweights = CustomPreviewLineweights(Geometry=curve_2, Shader=ColourSwatch(SwatchColor=RGB(255, 129, 0)), Absolute=False)

# ---- group: pipe_visualisation
number_slider_4 = Slider(0.1, range=0..1)
division_7 = Division(A=ghpython_script.radii_out, B=Slider(50, range=0..100))
range = Range(Domain=Domain(0, 1), Steps=expr("x-1", beam_divisions_2))
partition_list = PartitionList(List=ghpython_script.probe_points_out, Size=beam_divisions_2)  # -> simplify(Chunks)
partition_list_2 = PartitionList(List=division_7, Size=beam_divisions_2)  # -> simplify(Chunks)
polyline = PolyLine(Vertices=partition_list, Closed=False)
python = GhPythonScript(x=partition_list_2, min_radius=number_slider_4, max_radius=number_slider_2)  # -> out, a; inputs x: list
# ---------- python: Python ----------
__author__ = "SKIKK"
__version__ = "2022.12.15"

import rhinoscriptsyntax as rs

a= x

for i in range(len(x)):
    if x[i] < min_radius:
        a[i] = min_radius
    if x[i] > max_radius:
        a[i] = max_radius
# ---------- end python ----------
pipe_variable = PipeVariable(Curve=reparameterize(polyline), Parameters=range, Radii=python.a, Caps=0)
custom_preview_materials = CustomPreviewMaterials(Geometry=pipe_variable, DiffuseColor=RGB(255, 255, 255))

# ---- group: node spheres
point = Point(ghpython_script.probe_points_out)
list_length_3 = ListLength(List=point)
series = Series(Start=0, Step=beam_divisions_2, Count=list_length_3)
division_8 = Division(A=ghpython_script.radii_out, B=Slider(50, range=0..100))
python_2 = GhPythonScript(x=division_8, min_radius=number_slider_4, max_radius=number_slider_2)  # -> out, a; inputs x: list; same code as python
sphere = Sphere(Base=point, Radius=python_2.a)
list_item = ListItem(List=sphere, Index=series, Wrap=False)
# done:
# 
# highest tension on nodes
# vision and effect
# karamba search type List(Str)
# 3D
custom_preview_materials_2 = CustomPreviewMaterials(Geometry=list_item, DiffuseColor=RGB(255, 255, 255))

# ----
panel_12 = Panel(partition_list_2)
panel_13 = Panel(python.a)
# pfad | spannung | fläche
# bewegungsvektoramplituden = spannung/durschnittsspannung. wenn also  ein osteoblast an einer stelle ist, wo insgesamt mehr null-items + unterdurchschnittliche vectoren sind, bekommt er einen nullvektor und stirbt. warum?
# was wird hier korrigiert?
# hier wird normalisiert. warum?
# pfad | spannung | fläche
mesh = Mesh(beam_view_karamba3d.MeshesOfRenderedBeams)

# ---- group: osteoclast
C = ColourSwatch(SwatchColor=RGB(0, 0, 255))
B = ColourSwatch(SwatchColor=RGB(0, 255, 255))
point_2 = Point(ghpython_script.osteoclast_paths_out)
C_2 = ColourSwatch(SwatchColor=RGB(0, 0, 255))
range_2 = Range(Domain=Domain(0, 1), Steps=ghpython_script.iteration_counter)
list_item_2 = ListItem(List=point_2, Index=0, Wrap=True)  # -> Item1, Item
col = Colour([C, B])
col_2 = Colour(C_2)
interp = InterpolateData(Data=point_2, Parameter=range_2, Interpolation=1)
interp_2 = InterpolateData(Data=col, Parameter=range_2, Interpolation=2)
number_slider_5 = Slider(0.8, range=0..1)
C_3 = ColourSwatch(SwatchColor=RGB(0, 0, 255))
col_3 = Colour(C_3)

# ----
xz_plane = XZPlane(Origin=list_item_2.Item1)

# ---- group: osteoclast / target
preview = CustomPreview(Geometry=ghpython_script.osteoclast_targets_out, Material=col_2)

# ---- group: osteoclast / affect
sphere_2 = Sphere(Base=xz_plane, Radius=ghpython_script.agent_effect_radius)
circle = Circle(Plane=xz_plane, Radius=ghpython_script.agent_effect_radius)

# ---- group: osteoclast / vision
sphere_3 = Sphere(Base=xz_plane, Radius=ghpython_script.agent_vision_radius)
circle_2 = Circle(Plane=xz_plane, Radius=ghpython_script.agent_vision_radius)

# ----
preview_2 = CustomPreview(Geometry=circle, Material=col_3)

# ---- group: osteoclast (continued)
custom_preview_materials_3 = CustomPreviewMaterials(Geometry=sphere_2, DiffuseColor=col_3, Transparency=number_slider_5)

# ---- group: osteoclast / vision
custom_preview_materials_4 = CustomPreviewMaterials(Geometry=sphere_3, DiffuseColor=col_3, Transparency=number_slider_5)

# ---- group: osteoclast / effect
preview_3 = CustomPreview(Geometry=circle_2, Material=col_3)

# ---- group: osteoclast / path
preview_4 = CustomPreview(Geometry=interp, Material=interp_2)

# ---- group: osteoblast
point_3 = Point(ghpython_script.osteoblast_paths_out)
B_2 = ColourSwatch(SwatchColor=RGB(255, 255, 0))
C_4 = ColourSwatch(SwatchColor=RGB(255, 0, 0))
C_5 = ColourSwatch(SwatchColor=RGB(255, 0, 0))
list_item_3 = ListItem(List=point_3, Index=0, Wrap=True)  # -> Item1, Item
range_3 = Range(Domain=Domain(0, 1), Steps=ghpython_script.iteration_counter)
col_4 = Colour([C_4, B_2])
xz_plane_2 = XZPlane(Origin=list_item_3.Item1)
col_5 = Colour(C_5)
interp_3 = InterpolateData(Data=col_4, Parameter=range_3, Interpolation=2)
interp_4 = InterpolateData(Data=point_3, Parameter=range_3, Interpolation=1)
number_slider_6 = Slider(0.8, range=0..1)
C_6 = ColourSwatch(SwatchColor=RGB(255, 0, 0))
col_6 = Colour(C_6)

# ---- group: osteoblast / target
preview_5 = CustomPreview(Geometry=ghpython_script.osteoblast_targets_out, Material=col_5)

# ---- group: osteoblast / vision
sphere_4 = Sphere(Base=xz_plane_2, Radius=ghpython_script.agent_vision_radius)
circle_3 = Circle(Plane=xz_plane_2, Radius=ghpython_script.agent_vision_radius)

# ---- group: osteoblast / effect
sphere_5 = Sphere(Base=xz_plane_2, Radius=ghpython_script.agent_effect_radius)
circle_4 = Circle(Plane=xz_plane_2, Radius=ghpython_script.agent_effect_radius)

# ---- group: osteoblast (continued)
custom_preview_materials_5 = CustomPreviewMaterials(Geometry=sphere_5, DiffuseColor=col_6, Transparency=number_slider_6)
preview_6 = CustomPreview(Geometry=circle_3, Material=col_6)

# ---- group: osteoblast / vision
custom_preview_materials_6 = CustomPreviewMaterials(Geometry=sphere_4, DiffuseColor=col_6, Transparency=number_slider_6)

# ---- group: osteoblast / path
preview_7 = CustomPreview(Geometry=interp_4, Material=interp_3)

# ---- group: osteoblast / effect
preview_8 = CustomPreview(Geometry=circle_4, Material=col_6)
